# Grasshopper definition Mac_Studio.gh (Grasshopper 1.0.8)
# plug-ins: ScriptParasite

number_slider = Slider(95, range=0..100)
number_slider_2 = Slider(197, range=0..1000)
number_slider_3 = Slider(9, range=0..100)
scripts = ScriptsFolderPath("D:\Core_Files\Scripts\")

rectangle = Rectangle(x=number_slider_2, y=number_slider_2, radii=Slider(46.4, range=0..100))  # -> rect, joined, points, notes; inputs x: Double, y: Double, radii: list of Double, bend: Double
# ---------- rectangle: C# usings ----------
using System.Linq;
using Rhino.Display;
using System.Drawing;
# ---------- rectangle: C# ----------
    // Update 2025-05-24

    if (no_input("x")) x = 20;
    if (no_input("y")) y = 20;
    if (no_input("radii")) radii.AddRange(new[] { 0.0, 0.0, 0.0, 0.0 });
    if (no_input("bend")) bend = 0.72;

    int degree = 6;
    int ptnum = 4;
    double tol = 0.01;
    pt_list.Clear();
    radii_text.Clear();

    //  ------- I put the radii organising in here so that
    if (bend < 0) for (int i = 0; i < radii.Count; i++) { radii[i] *= 1.5; bend = 0.72; }

    double[] rads = new[] { radii[0], radii[0], radii[0], radii[0] };
    if (radii.Count == 2) { rads[1] = radii[0]; rads[2] = radii[1]; rads[3] = radii[1]; }
    else if (radii.Count == 3) { rads[1] = radii[1]; rads[2] = radii[2]; rads[3] = radii[2]; }
    else if (radii.Count == 4) { rads[1] = radii[1]; rads[2] = radii[2]; rads[3] = radii[3]; }

    for (int i = 0; i < 4; i++) Print($"{rads[i]}");

    corner_type ctype = corner_type.Blend;
    if (bend == 0) ctype = corner_type.Chamfer;
    else if (bend >= 1) ctype = corner_type.Arc;

    Curve[] r = super_rectangle(x, y, rads, ctype, bend, ptnum, degree);
    rect = r.Select(c => new GH_Curve(c));
    joined = new GH_Curve(Curve.JoinCurves(r, tol, false)[0]);

    Point3d[] pts = { new Point3d(-x * 0.5, -y * 0.5, 0), new Point3d(-x * 0.5, y * 0.5, 0), new Point3d(x * 0.5, y * 0.5, 0), new Point3d(x * 0.5, -y * 0.5, 0) };
    points = pts.Select(p => new GH_Point(p));
    pt_list = pts.ToList();

    if (bend < 0) rads = rads.Select(n => n / 1.5).ToArray();
    List<string> rad_vals = new List<string> { "", "", "", "" };
    if (rads.Where(i => i == 0).Count() != 4) rad_vals = new List<string> { Math.Round(rads[0], 3).ToString(), Math.Round(rads[1], 3).ToString(), Math.Round(rads[2], 3).ToString(), Math.Round(rads[3], 3).ToString() };
    for (int i = 0; i < 4; i++) if (rad_vals[i] == "-0") rad_vals[i] = "0";

    radii_text = rad_vals.ToList();

    notes = @"-ve radii will give true arc values if bend = 0.72
No radii input, gives a Simple Rectangle
1 radii input, gives a Rectangle with C2 corners (all the same)
Multi radii input, gives rectangle with multi corner sizes
Bend at 0 plus radii input, gives a chamfered rectangle
Bend at 1 plus radii input, gives a rectangle with arc corners";
# ---------- rectangle: C# additional code ----------
  public enum corner_type { Arc, Blend, Chamfer }

  public static Curve corner(double radius, Transform transform, out Point3d[] pt_list, corner_type c_type = corner_type.Blend, double blend = 0.72, int ptnum = 4, int degree = 6, double x_limit = 0, double y_limit = 0)
  {
    if (c_type == corner_type.Arc)
    {
      Point3d[] pts = {new Point3d(radius - x_limit, 0, 0), new Point3d(0, radius - y_limit, 0)};
      Curve crv = new ArcCurve( new Arc(pts[0], -Vector3d.XAxis, pts[1]));
      TransformGeos(pts, transform);
      crv.Transform(transform);
      pt_list = pts;
      return crv;
    }
    else if (c_type == corner_type.Chamfer) {
      Point3d[] pts = {new Point3d(radius - x_limit, 0, 0), new Point3d(0, radius - y_limit, 0)};
      Curve crv = new LineCurve(new Point3d(radius - x_limit, 0, 0), new Point3d(0, radius - y_limit, 0));
      TransformGeos(pts, transform);
      crv.Transform(transform);
      pt_list = pts;
      return crv;
    }
    else
    {
      double offset = radius * blend / (ptnum - 1);

      Point3d[] corner_points = new Point3d[ptnum * 2];
      double[] ratios = new double[ptnum];
      for (int i = 0; i < ptnum; i++) ratios[i] = radius - (i * offset);
      for (int i = 0; i < ptnum; i++)
      {
        corner_points[i] = new Point3d(ratios[i], 0, 0);
        corner_points[i + ptnum] = new Point3d(0, ratios[ptnum - i - 1], 0);
      }
      corner_points[0].X -= x_limit;
      corner_points[(ptnum * 2) -1].Y -= y_limit;
      TransformGeos(corner_points,transform);
      pt_list = corner_points;
      return Curve.CreateControlPointCurve(corner_points, degree);
    }
  }


 public Curve[] super_rectangle(double x, double y, double[] rads, corner_type c_type, double blend = 0.72, int half_ptnum = 4, int degree = 6)
  {
    double radA = rads[0];
    double radB = rads[1];
    double radC = rads[2];
    double radD = rads[3];

    double[] x_limits = {0,0,0,0};
    double[] y_limits = {0,0,0,0};
    bool[] side_lines = {true, true, true, true};

    if (radA + radB >= y){
      double limit = (radA + radB - y) * 0.5;
      y_limits[0] = limit;
      x_limits[1] = limit;
      side_lines[0] = false;
    }
    if (radB + radC >= x){
      double limit = (radB + radC - x) * 0.5;
      y_limits[1] = limit;
      x_limits[2] = limit;
      side_lines[1] = false;
    }
    if (radC + radD >= y){
      double limit = (radC + radD - y) * 0.5;
      y_limits[2] = limit;
      x_limits[3] = limit;
      side_lines[2] = false;
    }
    if (radD + radA >= x){
      double limit = (radD + radA - x) * 0.5;
      y_limits[3] = limit;
      x_limits[0] = limit;
      side_lines[3] = false;
    }

    x *= 0.5;
    y *= 0.5;

    Curve[] curves = new Curve[8];
    Transform[] transforms = new[]
    {
      Transform.Translation(-x, -y, 0),
      Transform.Translation(-x, y, 0) * Transform.Rotation(Math.PI * 1.5, Point3d.Origin),
      Transform.Translation(x, y, 0) * Transform.Rotation(Math.PI, Point3d.Origin),
      Transform.Translation(x, -y, 0) * Transform.Rotation(Math.PI * 0.5, Point3d.Origin)
    };

    Curve[] corners = new Curve[4];
    Curve[] sides = new Curve[4];

    int ptnum = half_ptnum << 1;

    Point3d[] pt_listA = new Point3d[ptnum];
    Point3d[] pt_listB = new Point3d[ptnum];
    Point3d[] pt_listC = new Point3d[ptnum];
    Point3d[] pt_listD = new Point3d[ptnum];


    corners[0] = (radA == 0)? null : corner(radA, transforms[0], out pt_listA, c_type, blend, half_ptnum, degree, x_limits[0], y_limits[0]);
    sides[0] = !side_lines[0] ? null : new LineCurve(new Point3d(-x, radA - y - y_limits[0], 0), new Point3d(-x, y - radB + x_limits[1], 0));
    corners[1] = (radB == 0)? null : corner(radB, transforms[1], out pt_listB, c_type, blend, half_ptnum, degree, x_limits[1], y_limits[1]);
    sides[1] = !side_lines[1] ? null : new LineCurve(new Point3d(radB - x - y_limits[1], y, 0), new Point3d(x - radC + x_limits[2], y, 0));
    corners[2] = (radC == 0)? null : corner(radC, transforms[2], out pt_listC, c_type, blend, half_ptnum, degree, x_limits[2], y_limits[2]);
    sides[2] = !side_lines[2] ? null : new LineCurve(new Point3d(x, y - radC + y_limits[2], 0), new Point3d(x, radD - y - x_limits[3], 0));
    corners[3] = (radD == 0)? null : corner(radD, transforms[3], out pt_listD, c_type, blend, half_ptnum, degree, x_limits[3], y_limits[3]);
    sides[3] = !side_lines[3] ? null : new LineCurve(new Point3d(x - radD+ y_limits[3], -y, 0), new Point3d(radA - x - x_limits[0], -y, 0));

  int zero_pt = ptnum;
  int last_pt = ptnum -1;
  int pen_pt = ptnum -2;

  bool[] combine_crvs = new bool[4]; // AB, BC, CD, DA
  combine_crvs[0] = radA != 0 && radB != 0 && (pt_listA[last_pt].Y < pt_listA[pen_pt].Y || pt_listA[last_pt].Y > pt_listB[1].Y);
  combine_crvs[1] = radB != 0 && radC != 0 && (pt_listB[last_pt].X < pt_listB[pen_pt].X || pt_listB[last_pt].X > pt_listC[1].X);
  combine_crvs[2] = radC != 0 && radD != 0 && (pt_listC[last_pt].Y > pt_listC[pen_pt].Y || pt_listC[last_pt].Y < pt_listD[1].Y);
  combine_crvs[3] = radD != 0 && radA != 0 && (pt_listD[last_pt].X > pt_listD[pen_pt].X || pt_listD[last_pt].X < pt_listA[1].X);

  //pen_pt = last_pt;
  last_pt = zero_pt;

  if (combine_crvs[0] && !combine_crvs[1] && !combine_crvs[3]){ corners[0] = Curve.CreateControlPointCurve(pt_listA[0..pen_pt].Concat(pt_listB[1..zero_pt]), degree); corners[1] = null;} // Print("AB");}
  if (combine_crvs[1] && !combine_crvs[2] && !combine_crvs[0]){ corners[1] = Curve.CreateControlPointCurve(pt_listB[0..pen_pt].Concat(pt_listC[1..zero_pt]), degree); corners[2] = null;} // Print("BC");}
  if (combine_crvs[2] && !combine_crvs[3] && !combine_crvs[1]){ corners[2] = Curve.CreateControlPointCurve(pt_listC[0..pen_pt].Concat(pt_listD[1..zero_pt]), degree); corners[3] = null;} // Print("CD");}
  if (combine_crvs[3] && !combine_crvs[0] && !combine_crvs[2]){ corners[3] = Curve.CreateControlPointCurve(pt_listD[0..pen_pt].Concat(pt_listA[1..zero_pt]), degree); corners[0] = null;} // Print("DA");}

  if (combine_crvs[0] && combine_crvs[1] && !combine_crvs[2] && !combine_crvs[3]){ corners[0] = Curve.CreateControlPointCurve(pt_listA[0..pen_pt].Concat(pt_listB[1..pen_pt]).Concat(pt_listC[1..last_pt]), degree); corners[1] = null; corners[2] = null;} // Print("ABC");}
  if (combine_crvs[1] && combine_crvs[2] && !combine_crvs[3] && !combine_crvs[0]){ corners[1] = Curve.CreateControlPointCurve(pt_listB[0..pen_pt].Concat(pt_listC[1..pen_pt]).Concat(pt_listD[1..last_pt]), degree); corners[2] = null; corners[3] = null;} // Print("BCD");}
  if (combine_crvs[2] && combine_crvs[3] && !combine_crvs[0] && !combine_crvs[1]){ corners[2] = Curve.CreateControlPointCurve(pt_listC[0..pen_pt].Concat(pt_listD[1..pen_pt]).Concat(pt_listA[1..last_pt]), degree); corners[3] = null; corners[0] = null;} // Print("CDA");}
  if (combine_crvs[3] && combine_crvs[0] && !combine_crvs[1] && !combine_crvs[2]){ corners[3] = Curve.CreateControlPointCurve(pt_listD[0..pen_pt].Concat(pt_listA[1..pen_pt]).Concat(pt_listB[1..last_pt]), degree); corners[0] = null; corners[1] = null;} // Print("DAB");}

  if (combine_crvs[0] && combine_crvs[1] && combine_crvs[2] && !combine_crvs[3]){ corners[0] = Curve.CreateControlPointCurve(pt_listA[0..pen_pt].Concat(pt_listB[1..pen_pt]).Concat(pt_listC[1..pen_pt]).Concat(pt_listD[1..last_pt]), degree); corners[1] = null; corners[2] = null;  corners[3] = null;} // Print("ABCD");}
  if (combine_crvs[1] && combine_crvs[2] && combine_crvs[3] && !combine_crvs[0]){ corners[1] = Curve.CreateControlPointCurve(pt_listB[0..pen_pt].Concat(pt_listC[1..pen_pt]).Concat(pt_listD[1..pen_pt]).Concat(pt_listA[1..last_pt]), degree); corners[2] = null; corners[3] = null;  corners[0] = null;} // Print("BCDA");}
  if (combine_crvs[2] && combine_crvs[3] && combine_crvs[0] && !combine_crvs[1]){ corners[2] = Curve.CreateControlPointCurve(pt_listC[0..pen_pt].Concat(pt_listD[1..pen_pt]).Concat(pt_listA[1..pen_pt]).Concat(pt_listB[1..last_pt]), degree); corners[3] = null; corners[0] = null;  corners[1] = null;} // Print("CDAB");}
  if (combine_crvs[3] && combine_crvs[0] && combine_crvs[1] && !combine_crvs[2]){ corners[3] = Curve.CreateControlPointCurve(pt_listD[0..pen_pt].Concat(pt_listA[1..pen_pt]).Concat(pt_listB[1..pen_pt]).Concat(pt_listC[1..last_pt]), degree); corners[0] = null; corners[1] = null;  corners[2] = null;} // Print("DABC");}

  if (combine_crvs[0] && combine_crvs[1] && combine_crvs[2] && combine_crvs[3]){ corners[0] = Curve.CreateControlPointCurve(pt_listA[1..pen_pt].Concat(pt_listB[1..pen_pt]).Concat(pt_listC[1..pen_pt]).Concat(pt_listD[1..pen_pt]), degree); corners[1] = null; corners[2] = null; corners[3] = null;} // Print("ALL");}

  int counter = 0;
  if (corners[0] != null) curves[counter++] = corners[0];
  if (sides[0] != null) curves[counter++] = sides[0];
  if (corners[1] != null) curves[counter++] = corners[1];
  if (sides[1] != null) curves[counter++] = sides[1];
  if (corners[2] != null) curves[counter++] = corners[2];
  if (sides[2] != null) curves[counter++] = sides[2];
  if (corners[3] != null) curves[counter++] = corners[3];
  if (sides[3] != null) curves[counter++] = sides[3];

  Array.Resize(ref curves, counter);

  return curves;
  }



  public static void TransformGeos(Point3d[] geos, Transform transform)
  {
    for (int i = 0; i < geos.Length; i++) geos[i].Transform(transform);
  }
  public static void TransformGeos(GeometryBase[] geos, Transform transform)
  {
    for (int i = 0; i < geos.Length; i++) geos[i].Transform(transform);
  }

  private bool no_input(string name) => Component.Params.Input[Component.Params.IndexOfInputParam(name)].SourceCount == 0;


  //Return a BoundingBox that contains all the geometry you are about to draw.
  public override BoundingBox ClippingBox => BoundingBox.Empty;

  double text_size = 0.75;
  //Draw all wires and points in this method.
  public override void DrawViewportWires(IGH_PreviewArgs args)
  {
    RhinoDoc doc = RhinoDoc.ActiveDoc;
    RhinoView view = doc.Views.ActiveView;
    RhinoViewport vp = view.ActiveViewport;
    vp.GetCameraFrame(out Plane pl);
    for (int i = 0; i < pt_list.Count; i++)
    {
      pl.Origin = pt_list[i];
      if (i == 0 || i == 3) pl.Transform(Transform.Translation(-pl.YAxis * text_size));
      Text3d text = new Text3d(radii_text[i].ToString(), pl, text_size);
      if (i == 0 || i == 1) text.HorizontalAlignment = Rhino.DocObjects.TextHorizontalAlignment.Right;

      args.Display.Draw3dText(text, Color.White);
      args.Display.DrawPoint(pt_list[i], Color.White);

    }
  }
  List<Point3d> pt_list = new List<Point3d>();
  List<string> radii_text = new List<string>();
# ---------- end rectangle ----------
para = ScriptParasite(Enable=Toggle(True), Folder=scripts)

panel = Panel(rectangle.notes)
subtraction = Subtraction(A=Slider(95, range=0..100), B=number_slider_3)
Z = UnitZ(Factor=number_slider_3)
move = Move(Geometry=rectangle.rect, Motion=Z)  # -> Geometry, Transform
scripts_2 = ScriptsFolderPath("D:\Core_Files\Scripts\")

extrude_punch = ExtrudeAndPunch(curves=move.Geometry, radii=Slider(0.5, range=0..1), extrude=subtraction)  # -> surfaces, pl, crv, notes; inputs curves: list, brep: Brep, radii: list of Double, bulges: list of Double, sectors: Int32, extrude: Double, inset: Double, flip: Boolean
# ---------- extrude_punch: C# usings ----------
using Rhino.Geometry.Intersect;
using System.Linq;
# ---------- extrude_punch: C# ----------
    // Updated 2025-05-24

    if (no_input("curves")) { if (!no_input("brep")) surfaces = new GH_Brep(brep); Component.Message = ""; return; }
    if (no_input("radii")) radii.Add(0);
    if (no_input("sectors")) sectors = 12;
    if (no_input("bulges")) bulges.Add(0.68);
    if (no_input("flip")) flip = false;

    double tol = 0.0001;
    Interval interval = new Interval(0, 1);
    Plane pln = Plane.WorldXY;

    Curve[] curve_list = object_curve_convert(curves);

    Curve[] curveloops = Curve.JoinCurves(curve_list, tol, true, false, out int[] keys);
    int idx = keys.Max() + 1;
    Plane[] planes = new Plane[idx];

    List<Curve> temp_crvs = new List<Curve>();
    List<int> temp_ints = new List<int>();
    for (int i = 0; i < idx; i++)
    {
      if (!curveloops[i].IsClosed) continue;
      Curve[] crvs = curve_list.Where((c, j) => keys[j] == i).ToArray();
      if (!no_input("inset") && inset != 0) crvs = offset(crvs, -inset, out planes[i], tol);
      else planes[i] = curves_plane(crvs);
      TransformGeos(crvs, Transform.Scale(planes[i], 1, 1, 0));

      int count = crvs.Length;
      if (count > 1)
      {
        sort_crv(crvs);
        clean_lines(ref crvs);
        match_crv_ends(crvs);
      }
      temp_crvs.AddRange(crvs);
      temp_ints.AddRange(Enumerable.Repeat(i, crvs.Length));
    }
    keys = temp_ints.ToArray();
    curve_list = temp_crvs.ToArray();

    if ((no_input("extrude") || extrude == 0) && (no_input("curves") || no_input("brep")))
    {
      crv = curve_list.Select(c => new GH_Curve(c));
      Component.Message = "Surface";
      if (!no_input("brep")) surfaces = new GH_Brep(brep);
      else surfaces = Brep.CreatePlanarBreps(curve_list, 0.001).Select(b => new GH_Brep(b));
      return;
    }

    if (no_input("extrude") && no_input("brep")) { Component.Message = ""; return; }


    // ------- Set Basic Conditions ------- //

    bool simple = no_input("radii");
    if (radii.Count == 1) radii.Add(radii[0]);
    if (radii[0] == 0 && radii[1] == 0) simple = true;
    bulges.Add(bulges[0]);

    bool has_extrude = (!no_input("extrude") && Math.Abs(extrude) > tol);
    bool has_brep = !no_input("brep");

    bool hole = has_brep && has_extrude;
    bool through_hole = has_brep && !has_extrude;
    bool extrusion = !hole && !through_hole;

    bool quick = false;
    bool mirror = false;
    bool centre = extrusion && flip;

    bool simple_extrude = extrusion && simple;
    bool normal_extrude = false;
    if (extrusion)
    {
      if (!simple) quick = radii[0] == radii[1];
      mirror = extrude != Math.Abs(extrude) && !centre;  // REVERSE direction of extrude (no point if the extrude is centred)
      normal_extrude = !mirror && !quick;
    }

    bool inner_hole = false;
    bool inner_though = false;
    if (flip)
    {
      inner_hole = hole;
      inner_though = through_hole;
      hole = false;
      through_hole = false;
    }
    if (hole && !inner_hole && flip) { hole = false; inner_hole = true; }

    // ------- Sort incoming curves ------- //

    List<Curve> all_crvs = new List<Curve>();
    List<Brep> all_breps = new List<Brep>();

    List<Plane> plane_list = new List<Plane>();


    // ------- Sort incoming curves ------- //

    for (int i = 0; i < idx; i++)
    {
      Curve[] crvs = curve_list.Where((c, j) => keys[j] == i).ToArray();
      int count = crvs.Length;

      Plane plane = planes[i];
      Transform orient = Transform.PlaneToPlane(plane, pln);
      Transform reorient = Transform.PlaneToPlane(pln, plane);

      if (has_brep) brep.Transform(orient);
      TransformGeos(crvs, orient);

      // Check that the curve is inside the Brep's bounds
      double edge_inset_caution = (through_hole || hole) && !simple ? 0.2 + Math.Max(radii[0], radii[1]) : 0.2;

      if (has_brep && !boxboxinside2D(brep.GetBoundingBox(true), bb_union(crvs, edge_inset_caution)))
      {
        brep.Transform(reorient);
        continue;
      }

      // ------- Construct Breps and Parts ------- //

      //Brep test_piece = new Brep();
      Plane base_plane = Plane.Unset;
      Curve[] hole_crvs = new Curve[count];
      Brep part = new Brep();
      if (simple_extrude) part = capped_extrude(crvs, out hole_crvs, extrude, centre, tol);
      else if (quick) part = quick_extrude(crvs, extrude, radii[0], bulges[0], sectors, centre, tol, out hole_crvs);
      else if (extrusion) part = full_extrude(crvs, extrude, radii, bulges, sectors, centre, tol, out hole_crvs);
      else if (hole) part = hole_extrude(crvs, brep, extrude, radii, bulges, sectors, tol, out base_plane, out hole_crvs);
      else if (inner_hole) part = hole_inner(crvs, brep, extrude, radii, bulges, sectors, tol, out base_plane, out hole_crvs);
      else if (through_hole) part = hole_through(crvs, brep, radii, bulges, sectors, tol, out hole_crvs);
      else if (inner_though) part = through_inner(crvs, brep, radii, bulges, sectors, tol, out hole_crvs);
      else continue;

      Curve[] hole_curves = hole_crvs.Where(c => c != null).ToArray();

      part.Transform(reorient);

      if (through_hole || hole) brep = part;
      else
      {
        all_breps.Add(part);
        if (has_brep) brep.Transform(reorient);
      }
      if (base_plane.IsValid) { base_plane.Transform(reorient); plane_list.Add(base_plane); }
      if (hole_curves.Length > 0) { TransformGeos(hole_curves, reorient); all_crvs.AddRange(hole_curves); }
    }

    if (all_breps.Count == 0) all_breps.Add(brep);
    crv = all_crvs.Select(c => new GH_Curve(c));
    pl = plane_list;
    surfaces = all_breps.Select(b => new GH_Brep(b));

    string identifier = "";
    if (simple_extrude) identifier = "Simple Extrude";
    else if (quick) identifier = "Quick Extrude";
    else if (extrusion) identifier = "Full Extrusion";
    else if (hole) identifier = "Indent Hole";
    else if (inner_hole) identifier = "Indent Hole Inner";
    else if (through_hole) identifier = "Through Hole";
    else if (inner_though) identifier = "Through Hole Inner";
    else identifier = "";

    Component.Message = identifier;


    string[] note_strings = {
      identifier
    };

    notes = note_strings;
# ---------- extrude_punch: C# additional code ----------
  private Brep hole_inner(Curve[] curves, Brep brep, double extrude, List<double> radii, List<double> bulges, int sectors, double tol, out Plane pl, out Curve[] crvs)
  {
    Point3d pu = Point3d.Unset;
    double gap = 1 / (sectors - 1.0);
    Plane pln = Plane.WorldXY;
    int count = curves.Length;
    Interval interval = new Interval(0, 1);
    int cross_numA = (bulges[0] == 0) ? 2 : (radii[0] < 0.25) ? 4 : 5;
    int cross_numB = (bulges[1] == 0) ? 2 :(radii[1] < 0.25) ? 4 : 5;


    bool remirror = brep.GetBoundingBox(true).Center.Z < 0;  // Put Brep above Plane.XY
    Transform mirror = Transform.Mirror(pln);
    if (remirror) brep.Transform(mirror);

    if (extrude == 0) { pl = pln; crvs = curves; return brep; } //brep
    bool flip = extrude < 0;


    // ------- Separate BrepFaces ------- //

    Brep[] final_breps = new Brep[count * 3 + 2];
    separate_brepfaces(brep, curves, Vector3d.ZAxis, out Brep brep_half, out Brep brep_out);


    // ------- Initial Geometry to be copied and transformed ------- //

    double radA = -radii[0]; //inset removed
    double radB = -radii[1]; //inset removed

    double len = 0.1;
    Surface cutter = planar_srf(len, len);
    cutter.Transform(Transform.Translation(0, len * 0.5, 0));

    double[] ts = Enumerable.Range(0, sectors).Select(x => x * gap).ToArray();

    Plane base_plane = pln;
    Plane inside_plane = pln;
    Point3d central_pt = project_point(Point3d.Origin, brep, Vector3d.ZAxis);
    base_plane.Origin = new Point3d(central_pt.X, central_pt.Y, central_pt.Z + extrude);


    // ------- Create test to see if surface is flat.  If so, a more simple construction can be used ------- //

    Curve[] test_flat_crvs = new Curve[count * 2];
    Array.Copy(offset(curves, radA - 0.1, out _, tol), test_flat_crvs, count);
    Array.Copy(curves, 0, test_flat_crvs, count, count);

    bool flat_srf = test_flat(test_flat_crvs, brep_half, Vector3d.ZAxis, tol, out _);

    if(test_flat(test_flat_crvs, brep_half, Vector3d.ZAxis, tol, out _))
    {
      double extrude_val = remirror ? -extrude : extrude;
      Curve[] quick_crvs= curves.Select(c => project_closest(c, brep_half, Vector3d.ZAxis, tol)).ToArray();
      Brep quick_brep = full_extrude(quick_crvs, extrude_val, radii, bulges, sectors, false, tol, out Curve[] out_crvs);

      pl = new Plane(new Point3d(0,0,extrude), Vector3d.XAxis, Vector3d.YAxis); // base_plane; //
      crvs = out_crvs;

      return quick_brep;
    }


    // ------- Setup Curves ------- //

    Curve[] crvA = offset(curves, radA, out _, tol);
    Curve[] crvB = curves.Select(c => c.DuplicateCurve()).ToArray(); // offset(curves, -inset, tol);
    Curve[] crvD = offset(curves, radB, out _, tol);

    crvA = crvA.Select(c => project_closest(c, brep_half, Vector3d.ZAxis, tol)).ToArray();
    crvB = crvB.Select(c => project_closest(c, brep_half, Vector3d.ZAxis, tol)).ToArray();

    sort_crvs(pln, crvA, crvB);
    sort_crvs(pln, crvA, crvD);

    match_crv_ends(crvA);
    match_crv_ends(crvB);
    match_crv_ends(crvB);

    Curve[] crvC = crvB.Select(c => c.DuplicateCurve()).ToArray();


    double z_move = base_plane.OriginZ;
    double inside_z = z_move - radii[1];

    inside_plane.OriginZ = inside_z;
    TransformGeos(crvB, Transform.Translation(0, 0, radii[0]));
    TransformGeos(crvC, Transform.Scale(inside_plane, 1, 1, 0));
    TransformGeos(crvD, Transform.Scale(base_plane, 1, 1, 0));


    // ------- main loop ------- //

    for (int i = 0; i < count; i++)
    {
      if (radii[0] == 0 && radii[1] == 0) { final_breps[count + i] = Brep.CreateFromLoft(new[] { crvB[i], crvC[i] }, pu, pu, LoftType.Straight, false)[0]; continue; } //circle_check(ref crvA[i]); //circle_check(ref crvB[i]); // can remove if simple circle hole built later //circle_check(ref crvC[i]); //circle_check(ref crvD[i]);
      crvA[i].Domain = interval; crvB[i].Domain = interval; crvC[i].Domain = interval; crvD[i].Domain = interval;


      bool straight = crvA[i].IsLinear(0.01) && crvB[i].IsLinear(0.01);

      Curve[] edges_A = new Curve[sectors];
      Curve[] edges_B = new Curve[sectors];

      for (int j = 0; j < sectors; j++)
      {
        Point3d pB = crvB[i].PointAt(ts[j]);
        Point3d pC = new Point3d(pB.X, pB.Y, inside_z);
        Curve lnA = new LineCurve(pB, pC);
        bool straight_check = (!straight || (straight && (j == 0 || j == sectors - 1)));

        if (radii[0] != 0 && straight_check)
        {
          Point3d pA = crvA[i].PointAt(ts[j]);
          Vector3d vec = new Vector3d(pA - pB) { Z = 0 };

          Plane frame = new Plane(pA, Vector3d.ZAxis, vec);
          Transform frame_trans = Transform.PlaneToPlane(Plane.WorldZX, frame);

          cutter.Transform(Transform.PlaneToPlane(pln, frame));
          Intersection.BrepSurface(brep_half, cutter, tol, out Curve[] int_crvs, out _);
          cutter.Transform(Transform.PlaneToPlane(frame, pln));
          Curve cx_crv;
          if (pA.EpsilonEquals(int_crvs[0].PointAtEnd, 0.01)) cx_crv = int_crvs[0];
          else{
            cx_crv = (int_crvs.Length > 1) ? Curve.JoinCurves(int_crvs, tol, false)[0] : int_crvs[0];
            if (pA.EpsilonEquals(cx_crv.PointAtEnd, 0.01)) cx_crv.Reverse();
          }
          edges_A[j] = Curve.CreateBlendCurve(cx_crv, lnA, BlendContinuity.Curvature, bulges[0], bulges[0]);
        }

        if (radii[1] != 0 && straight_check)
        {
          Point3d pD = crvD[i].PointAt(ts[j]);
          Vector3d vec = new Vector3d(pD - pB) { Z = 0 };
          Curve lnB = new LineCurve(new Line(pD, vec, 1));
          edges_B[j] = Curve.CreateBlendCurve(lnA, lnB, BlendContinuity.Curvature, bulges[1], bulges[1]);
        }
      }

      if (radii[0] != 0)
      {
        if (straight) final_breps[i] = (bulges[0] == 0)
            ? Brep.CreateFromLoft(new[] { crvA[i], crvB[i] }, pu, pu, LoftType.Straight, false)[0]
            : Brep.CreateFromLoft(new[] { edges_A[0], edges_A[sectors - 1] }, pu, pu, LoftType.Straight, false)[0];

        else final_breps[i] = (bulges[0] == 0)
          ? Brep.CreateFromLoft(new[] { crvA[i], crvB[i] }, pu, pu, LoftType.Straight, false)[0]
          : edge_srf(crvA[i], crvB[i] , edges_A, cross_numA);
      }
      if (radii[1] != 0)
      {
        if (straight) final_breps[(count * 2) + i] = (bulges[1] == 0)
            ? Brep.CreateFromLoft(new[] { crvC[i], crvD[i] }, pu, pu, LoftType.Straight, false)[0]
            : Brep.CreateFromLoft(new[] { edges_B[0], edges_B[sectors - 1] }, pu, pu, LoftType.Straight, false)[0];
        else final_breps[(count * 2) + i] = (bulges[1] == 0)
          ? Brep.CreateFromLoft(new[] { crvC[i], crvD[i] }, pu, pu, LoftType.Straight, false)[0]
          : edge_srf( crvC[i], crvD[i], edges_B, cross_numB);
      }
      final_breps[count + i] = Brep.CreateFromLoft(new[] { crvB[i], crvC[i] }, pu, pu, LoftType.Straight, false)[0]; // edge_srf( crvB[i], crvC[i], null, cross_numB);//
    }


    // ------- Re-Assemble parts ------- //

    Brep final_brep = new Brep();

    final_breps[count * 3] = Brep.CreatePlanarBreps(crvD, 0.001)[0];

    BoundingBox target_bb = bb_union(crvA, 0.1);
    List<Brep> pieces = brep_half.Split(crvA, tol).Where(b => boxboxinside2D(target_bb, b.GetBoundingBox(true))).ToList();
    pieces.AddRange(final_breps.Where(b => b != null));
    final_brep = Brep.JoinBreps(pieces, 0.001, 0.1)[0];
    // for (int i = 0; i < pieces.Count; i++) final_brep.Append(pieces[i]);

    base_plane = new Plane(base_plane.Origin, -base_plane.XAxis, -base_plane.YAxis);

    if (remirror)
    {
      final_brep.Transform(mirror);
      brep.Transform(mirror);
      base_plane.Transform(mirror);
      TransformGeos(crvA, mirror);
    }

    if (final_brep.SolidOrientation == BrepSolidOrientation.Inward) final_brep.Flip();

    pl = base_plane; // Plane.WorldXY; //
    crvs = crvA; //  new[] { new LineCurve(Point3d.Origin, new Point3d(0, 0, 1)) }; //crvD; //

    return final_brep; // new Brep(); //
  }

  private Brep hole_extrude(Curve[] curves, Brep brep, double extrude, List<double> radii, List<double> bulges, int sectors, double tol, out Plane pl, out Curve[] crvs)
  {
    Point3d pu = Point3d.Unset;
    double gap = 1 / (sectors - 1.0);
    Plane pln = Plane.WorldXY;
    int count = curves.Length;
    Interval interval = new Interval(0,1);

    int cross_numA = (bulges[0] == 0) ? 2 : 4;
    int cross_numB = (bulges[1] == 0) ? 2 : 4;

    bool remirror = brep.GetBoundingBox(true).Center.Z < 0;  // Put Brep above Plane.XY
    Transform mirror = Transform.Mirror(Plane.WorldXY);
    if (remirror) brep.Transform(mirror);

    if (extrude == 0) { pl = pln; crvs = curves; return brep; }
    double flip = (extrude < 0) ? -1 : 1;


    // ------- Setup Curves ------- //

    double radA = radii[0];
    double radB = -radii[1];

    Curve[] crvA = (radii[0] == 0)
    ? curves.Select(c => c.DuplicateCurve()).ToArray()
    : offset(curves, radA, out _, tol);


    // ------- Separate BrepFaces ------- //

    Brep[] final_breps = new Brep[count * 3 + 3];
    separate_brepfaces(brep, crvA, Vector3d.ZAxis, out Brep brep_half, out Brep brep_out);
    final_breps[count * 3 + 1] = brep_out;

    double len = 0.2;
    Surface cutter = planar_srf(len, len);
    cutter.Transform(Transform.Translation(0, len * 0.5, 0));

    double[] ts = Enumerable.Range(0, sectors).Select(x => x * gap).ToArray();


    // ------- Setup Curves ------- //

    Curve[] crvB = curves.Select(c => c.DuplicateCurve()).ToArray();

    Curve[] crvD = (radii[1] == 0)
      ? curves.Select(c => c.DuplicateCurve()).ToArray()
      : offset(curves, radB, out _, tol);

    crvA = crvA.Select(c => project_closest(c, brep_half, Vector3d.ZAxis, tol)).ToArray();
    crvB = (radii[0] == 0)
      ? crvA.Select(c => c.DuplicateCurve()).ToArray()
      : crvB.Select(c => project_closest(c, brep_half, Vector3d.ZAxis, tol)).ToArray();

    sort_crvs(pln, crvA, crvB);
    sort_crvs(pln, crvA, crvD);
    Curve[] crvC = crvB.Select(c => c.DuplicateCurve()).ToArray();


    Plane base_plane = Plane.WorldXY;
    Plane inside_plane = Plane.WorldXY;
    Point3d central_pt = project_point(Point3d.Origin, brep, Vector3d.ZAxis);
    base_plane.Origin = central_pt;
    base_plane.Transform(Transform.Translation(0, 0, extrude));
    double z_move = base_plane.OriginZ;

    double inside_z = base_plane.OriginZ - (radii[1] * flip);
    inside_plane.OriginZ = inside_z;
    TransformGeos(crvB, Transform.Translation(0, 0, (radii[0]) * flip));
    TransformGeos(crvC, Transform.Scale(inside_plane, 1, 1, 0));
    TransformGeos(crvD, Transform.Scale(base_plane, 1, 1, 0));


    // ------- Create test to see if surface is flat.  If so, a more simple construction can be used ------- //

    Curve[] test_flat_crvs = new Curve[count * 2];
    Array.Copy(offset(curves, radA - 0.1, out _, tol), test_flat_crvs, count);
    Array.Copy(crvA, 0, test_flat_crvs, count, count);

    bool flat_srf = test_flat(test_flat_crvs, brep_half, Vector3d.ZAxis, tol, out _);


    // ------- main loop ------- //

    List<Curve> test_crvs = new List<Curve>();

    for (int i = 0; i < count; i++)
    {
      crvA[i].Domain = interval;
      crvB[i].Domain = interval;
      crvC[i].Domain = interval;
      crvD[i].Domain = interval;

      bool straight = crvA[i].IsLinear(0.01);  //crvA[i].IsLinear(0.01) && crvB[i].IsLinear(0.01);

      Curve[] edges_A = new Curve[sectors];
      Curve[] edges_B = new Curve[sectors];

      for (int j = 0; j < sectors; j++)
      {
        Point3d pB = crvB[i].PointAt(ts[j]);
        Point3d pC = new Point3d(pB.X, pB.Y, inside_z);
        Curve lnA = new LineCurve(pB, pC);
        bool straight_check = (!straight || (straight && (j == 0 || j == sectors - 1)));

        if (radii[0] != 0 && straight_check && bulges[0] != 0)
        {
          Point3d pA = crvA[i].PointAt(ts[j]);
          Vector3d vec = new Vector3d(pA - pB) { Z = 0 };

          if (flat_srf)
          {
            Curve top_ln = new LineCurve(pA + vec, pA);
            edges_A[j] = Curve.CreateBlendCurve(top_ln, lnA, BlendContinuity.Curvature, bulges[0], bulges[0]);
          }
          else
          {
            Plane frame = new Plane(pA, Vector3d.ZAxis, vec);
            Transform frame_trans = Transform.PlaneToPlane(Plane.WorldZX, frame);

            cutter.Transform(Transform.PlaneToPlane(pln, frame));
            Intersection.BrepSurface(brep_half, cutter, tol, out Curve[] int_crvs, out _);
            cutter.Transform(Transform.PlaneToPlane(frame, pln));

            Curve cx_crv = (int_crvs.Length > 1) ? Curve.JoinCurves(int_crvs, tol, false)[0] : int_crvs[0];
            if (central_pt.DistanceToSquared(cx_crv.PointAtEnd) < central_pt.DistanceToSquared(cx_crv.PointAtStart)) cx_crv.Reverse();
            edges_A[j] = Curve.CreateBlendCurve(cx_crv, lnA, BlendContinuity.Curvature, bulges[0], bulges[0]);
          }
        }

        if (radii[1] != 0 && straight_check && bulges[1] != 0)
        {
          Point3d pD = crvD[i].PointAt(ts[j]);
          Vector3d vec = new Vector3d(pD - pB) { Z = 0 };
          Curve lnB = new LineCurve(new Line(pD, vec, 1));
          edges_B[j] = Curve.CreateBlendCurve(lnA, lnB, BlendContinuity.Curvature, bulges[1], bulges[1]);
        }
      }

      if (radii[0] != 0)
      {
        if (straight) final_breps[i] = (bulges[0] == 0)
            ? Brep.CreateFromLoft(new[] { crvA[i], crvB[i] }, pu, pu, LoftType.Straight, false)[0]
            : Brep.CreateFromLoft(new[] { edges_A[0], edges_A[sectors - 1] }, pu, pu, LoftType.Straight, false)[0];
        else final_breps[i] = (bulges[0] == 0)
          ? Brep.CreateFromLoft(new[] { crvA[i], crvB[i] }, pu, pu, LoftType.Straight, false)[0]
          : edge_srf(crvA[i], crvB[i], edges_A, cross_numA);
      }

      if (radii[1] != 0)
      {
        if (straight) final_breps[(count * 2) + i] = (bulges[1] == 0)
            ? Brep.CreateFromLoft(new[] { crvC[i], crvD[i] }, pu, pu, LoftType.Straight, false)[0]
            : Brep.CreateFromLoft(new[] { edges_B[0], edges_B[sectors - 1] }, pu, pu, LoftType.Straight, false)[0];
        else final_breps[(count * 2) + i] = (bulges[1] == 0)
          ? Brep.CreateFromLoft(new[] { crvC[i], crvD[i] }, pu, pu, LoftType.Straight, false)[0]
          : edge_srf(crvC[i], crvD[i], edges_B, cross_numB);
      }
      final_breps[count + i] = Brep.CreateFromLoft(new[] { crvB[i], crvC[i] }, pu, pu, LoftType.Straight, false)[0];
    }


    // ------- Re-Assemble parts ------- //

    final_breps[count * 3] = Brep.CreatePlanarBreps(crvD, 0.001)[0];

    BoundingBox target_bb = bb_union(crvA);
    target_bb.Inflate(0.1);

    List<Brep> pieces = brep_half.Split(crvA, tol).Where(b => !boxboxinside2D(target_bb, b.GetBoundingBox(true))).ToList();

    pieces.AddRange(final_breps);

    Brep final_brep =  Brep.JoinBreps(pieces, 0.001, 0.1)[0]; // new Brep(); //


    base_plane = new Plane(base_plane.Origin, -base_plane.XAxis, -base_plane.YAxis);

    if (remirror)
    {
      final_brep.Transform(mirror);
      brep.Transform(mirror);
      base_plane.Transform(mirror);
      TransformGeos(crvA, mirror);
    }

    if (final_brep.SolidOrientation == BrepSolidOrientation.Inward) final_brep.Flip();

    pl = base_plane; // Plane.WorldXY; //
    crvs = crvA; // crvA.Concat(crvB).Concat(crvC).Concat(crvD).ToArray(); // new[] { new LineCurve(Point3d.Origin, new Point3d(0, 0, 1)) }; // crvD; //

    return final_brep; // new Brep(); //
  }

  private Brep hole_through(Curve[] curves, Brep brep, List<double> radii, List<double> bulges, int sectors, double tol, out Curve[] crvs)
  {
    Point3d pu = Point3d.Unset;
    double gap = 1 / (sectors - 1.0);
    Plane pln = Plane.WorldXY;
    int count = curves.Length;
    Interval interval = new Interval(0,1);

    //List<Curve> test_crvs = new List<Curve>();

    int cross_numA = (bulges[0] == 0) ? 2 : 4;
    int cross_numB = (bulges[1] == 0) ? 2 : 4;

    Transform mirror = Transform.Mirror(Plane.WorldXY);
    bool remirror = brep.GetBoundingBox(true).Center.Z < 0;
    if (remirror) brep.Transform(mirror);


    // ------- Setup Curves ------- //

    double radA = radii[0];
    double radB = radii[1];


    Curve[] crvB = curves.Select(c => c.DuplicateCurve()).ToArray();
    Curve[] crvC = crvB.Select(c => c.DuplicateCurve()).ToArray();

    Curve[] crvA = (radii[0] == 0)
      ? curves.Select(c => c.DuplicateCurve()).ToArray()
      : offset(curves, radA, out _, tol);

    Curve[] crvD = (radii[1] == 0)
      ? curves.Select(c => c.DuplicateCurve()).ToArray()
      : offset(curves, radB, out _, tol);

    Point3d pt_on_other_side = new Point3d(0, 0, brep.GetBoundingBox(true).Max.Z + 1);
    Transform move_to_other_sides = Transform.Translation(new Vector3d(pt_on_other_side));
    TransformGeos(crvC, move_to_other_sides);
    TransformGeos(crvD, move_to_other_sides);


    Curve[] test_flat_crvsA = new Curve[count * 2];
    Array.Copy(offset(crvA, 0.1, out _, tol), test_flat_crvsA, count);
    Array.Copy(crvA, 0, test_flat_crvsA, count, count);

    Curve[] test_flat_crvsD = new Curve[count * 2];
    Array.Copy(offset(crvD, 0.1, out _, tol), test_flat_crvsD, count);
    Array.Copy(crvD, 0, test_flat_crvsD, count, count);

    // ------- Separate BrepFaces ------- //

    Brep[] final_breps = new Brep[count * 3];
    separate_brepfaces(brep, crvA, Vector3d.ZAxis, out Brep brep_halfA, out Brep brep_out);
    separate_brepfaces(brep_out, crvD, -Vector3d.ZAxis, out Brep brep_halfB, out brep_out);

    double len = 0.2;
    Surface cutter = planar_srf(len, len);
    cutter.Transform(Transform.Translation(0, len * 0.5, 0));

    double[] ts = Enumerable.Range(0, sectors).Select(x => x * gap).ToArray();


    // ------- Project Curves ------- //

    crvA = crvA.Select(c => project_closest(c, brep_halfA, Vector3d.ZAxis, tol)).ToArray();
    crvB = (radii[0] == 0)
      ? crvA.Select(c => c.DuplicateCurve()).ToArray()
      : crvB.Select(c => project_closest(c, brep_halfA, Vector3d.ZAxis, tol)).ToArray();


    crvD = crvD.Select(c => project_closest(c, brep_halfB, -Vector3d.ZAxis, tol)).ToArray();
    crvC = (radii[1] == 0)
      ? crvD.Select(c => c.DuplicateCurve()).ToArray()
      : crvC.Select(c => project_closest(c, brep_halfB, -Vector3d.ZAxis, tol)).ToArray();

    sort_crvs(pln, curves, crvA);
    sort_crvs(pln, curves, crvB);
    sort_crvs(pln, curves, crvC);
    sort_crvs(pln, curves, crvD);

    Point3d central_ptA = project_point(Point3d.Origin, brep_halfA, Vector3d.ZAxis);
    Point3d central_ptB = project_point(pt_on_other_side, brep_halfB, -Vector3d.ZAxis);

    crvs = crvB.Select(c => c.DuplicateCurve()).ToArray();

    TransformGeos(crvB, Transform.Translation(0, 0, radii[0]));
    TransformGeos(crvC, Transform.Translation(0, 0, -radii[1]));


    // ------- Create test to see if surface is flat.  If so, a more simple construction can be used ------- //

    bool flat_srfA = test_flat(test_flat_crvsA, brep_halfA, Vector3d.ZAxis, tol, out _);
    bool flat_srfB = test_flat(test_flat_crvsD, brep_halfB, -Vector3d.ZAxis, tol, out _);


    // ------- main loop ------- //

    for (int i = 0; i < count; i++)
    {
      crvA[i].Domain = interval;
      crvB[i].Domain = interval;
      crvC[i].Domain = interval;
      crvD[i].Domain = interval;

      bool straightA = crvA[i].IsLinear(0.01);  //crvA[i].IsLinear(0.01) && crvB[i].IsLinear(0.01);
      bool straightB = crvD[i].IsLinear(0.01);

      Curve[] edges_A = new Curve[sectors];
      Curve[] edges_B = new Curve[sectors];

      for (int j = 0; j < sectors; j++)
      {
        Point3d pB = crvB[i].PointAt(ts[j]);
        Point3d pC = crvC[i].PointAt(ts[j]);
        Curve ln = new LineCurve(pC, pB);

        bool straight_checkA = (!straightA || (straightA && (j == 0 || j == sectors - 1)));
        bool straight_checkB = (!straightB || (straightB && (j == 0 || j == sectors - 1)));

        if (radii[0] != 0 && straight_checkA && bulges[0] != 0)
        {
          Point3d pA = crvA[i].PointAt(ts[j]);
          Vector3d vec = new Vector3d(pA - pB) { Z = 0 };

          if (flat_srfA)
          {
            Curve top_ln = new LineCurve(pA, pA + vec);
            edges_A[j] = Curve.CreateBlendCurve(ln, top_ln, BlendContinuity.Curvature, bulges[0], bulges[0]);
          }
          else
          {
            Plane frame = new Plane(pA, Vector3d.ZAxis, vec);
            Transform frame_trans = Transform.PlaneToPlane(Plane.WorldZX, frame);

            cutter.Transform(Transform.PlaneToPlane(pln, frame));
            Intersection.BrepSurface(brep_halfA, cutter, tol, out Curve[] int_crvs, out _);
            cutter.Transform(Transform.PlaneToPlane(frame, pln));

            Curve cx_crv = (int_crvs.Length > 1) ? Curve.JoinCurves(int_crvs, tol, false)[0] : int_crvs[0];
            if (central_ptA.DistanceToSquared(cx_crv.PointAtEnd) < central_ptA.DistanceToSquared(cx_crv.PointAtStart)) cx_crv.Reverse();
            edges_A[j] = Curve.CreateBlendCurve(ln, cx_crv, BlendContinuity.Curvature, bulges[0], bulges[0]);
            //int_crvs[0].Reverse();
            //edges_A[j] = Curve.CreateBlendCurve(ln, int_crvs[0], BlendContinuity.Curvature, bulges[0], bulges[0]);
          }
        }

        if (radii[1] != 0 && straight_checkB && bulges[1] != 0)
        {
          Point3d pD = crvD[i].PointAt(ts[j]);
          Vector3d vec = new Vector3d(pD - pC) { Z = 0 };

          if (flat_srfB)
          {
            Curve top_ln = new LineCurve(pD + vec, pD);
            edges_B[j] = Curve.CreateBlendCurve(top_ln, ln, BlendContinuity.Curvature, bulges[1], bulges[1]);
          }
          else
          {
            Plane frame = new Plane(pD, -Vector3d.ZAxis, vec);
            Transform frame_trans = Transform.PlaneToPlane(Plane.WorldZX, frame);

            cutter.Transform(Transform.PlaneToPlane(pln, frame));
            Intersection.BrepSurface(brep_halfB, cutter, tol, out Curve[] int_crvs, out _);
            cutter.Transform(Transform.PlaneToPlane(frame, pln));

            Curve cx_crv = (int_crvs.Length > 1) ? Curve.JoinCurves(int_crvs, tol, false)[0] : int_crvs[0];
            if (central_ptB.DistanceToSquared(cx_crv.PointAtEnd) < central_ptB.DistanceToSquared(cx_crv.PointAtStart)) cx_crv.Reverse();
            edges_A[j] = Curve.CreateBlendCurve(cx_crv, ln, BlendContinuity.Curvature, bulges[1], bulges[1]);

            //edges_B[j] = Curve.CreateBlendCurve(int_crvs[0], ln, BlendContinuity.Curvature, bulges[1], bulges[1]);
          }
        }
      }

      if (radii[0] != 0)
      {
        if (straightA) final_breps[i] = (bulges[0] == 0)
            ? Brep.CreateFromLoft(new[] { crvA[i], crvB[i] }, pu, pu, LoftType.Straight, false)[0]
            : Brep.CreateFromLoft(new[] { edges_A[0], edges_A[sectors - 1] }, pu, pu, LoftType.Straight, false)[0];
        else final_breps[i] = (bulges[0] == 0)
          ? Brep.CreateFromLoft(new[] { crvB[i], crvA[i] }, pu, pu, LoftType.Straight, false)[0]
          : edge_srf(crvB[i], crvA[i], edges_A, cross_numA);
      }
      if (radii[1] != 0)
      {
        if (straightB) final_breps[(count * 2) + i] = (bulges[1] == 0)
            ? Brep.CreateFromLoft(new[] { crvC[i], crvD[i] }, pu, pu, LoftType.Straight, false)[0]
            : Brep.CreateFromLoft(new[] { edges_B[0], edges_B[sectors - 1] }, pu, pu, LoftType.Straight, false)[0];
        else final_breps[(count * 2) + i] = (bulges[1] == 0)
          ? Brep.CreateFromLoft(new[] { crvD[i], crvC[i] }, pu, pu, LoftType.Straight, false)[0]
          : edge_srf(crvD[i], crvC[i], edges_B, cross_numB);
      }
      final_breps[count + i] = Brep.CreateFromLoft(new[] { crvB[i], crvC[i] }, pu, pu, LoftType.Straight, false)[0];
    }


    if (remirror) brep.Transform(mirror);

    BoundingBox test_boxA = bb_union(crvA, 0.2);
    BoundingBox test_boxB = bb_union(crvD, 0.2);

    List<Brep> pieces = brep_halfA.Split(crvA, tol).Where(b => !boxboxinside2D(test_boxA, b.GetBoundingBox(true))).ToList();
    pieces.AddRange(brep_halfB.Split(crvD, tol).Where(b => !boxboxinside2D(test_boxB, b.GetBoundingBox(true))));
    pieces.AddRange(final_breps);
    pieces.Add(brep_out);

    Brep[] parts = Brep.JoinBreps(pieces.Where(p => p != null), 0.001, 0.1);
    Brep final_brep = new Brep();
    for (int i = 0; i < parts.Length; i++) if (parts[i] != null) final_brep.Append(parts[i]);

    if (remirror)
    {
      final_brep.Transform(mirror);
      brep.Transform(mirror);
    }

    if (final_brep.SolidOrientation == BrepSolidOrientation.Inward) final_brep.Flip();

    return final_brep;
  }

  private Brep through_inner(Curve[] curves, Brep brep, List<double> radii, List<double> bulges, int sectors, double tol, out Curve[] crvs)
  {
    Point3d pu = Point3d.Unset;
    double gap = 1 / (sectors - 1.0);
    Plane pln = Plane.WorldXY;
    int count = curves.Length;
    Interval interval = new Interval(0,1);

    int cross_numA = (bulges[0] == 0) ? 2 : 4;
    int cross_numB = (bulges[1] == 0) ? 2 : 4;

    Transform mirror = Transform.Mirror(Plane.WorldXY);
    bool remirror = brep.GetBoundingBox(true).Center.Z < 0;
    if (remirror) brep.Transform(mirror);


    // ------- Setup Curves & Adjust for Inset ------- //

    double radA = -(radii[0]); //inset removed
    double radB = -(radii[1]); //inset removed


    Curve[] crvB = curves.Select(c => c.DuplicateCurve()).ToArray(); // offset(curves, -inset, tol);
    Curve[] crvC = crvB.Select(c => c.DuplicateCurve()).ToArray();

    Curve[] crvA = (radii[0] == 0)
      ? curves.Select(c => c.DuplicateCurve()).ToArray() //offset(curves, -inset, tol)
      : offset(curves, radA, out _, tol);

    Curve[] crvD = (radii[1] == 0)
      ? curves.Select(c => c.DuplicateCurve()).ToArray() //offset(curves, -inset, tol)
      : offset(curves, radB, out _, tol);

    Point3d pt_on_other_side = new Point3d(0, 0, brep.GetBoundingBox(true).Max.Z + 1);
    Transform move_to_other_sides = Transform.Translation(new Vector3d(pt_on_other_side));
    TransformGeos(crvC, move_to_other_sides);
    TransformGeos(crvD, move_to_other_sides);


    Curve[] test_flat_crvsA = new Curve[count * 2];
    Array.Copy(offset(crvA, 0.1, out _, tol), test_flat_crvsA, count);
    Array.Copy(crvA, 0, test_flat_crvsA, count, count);

    Curve[] test_flat_crvsD = new Curve[count * 2];
    Array.Copy(offset(crvD, 0.1, out _, tol), test_flat_crvsD, count);
    Array.Copy(crvD, 0, test_flat_crvsD, count, count);


    // ------- Separate BrepFaces ------- //

    Brep[] final_breps = new Brep[count * 3];
    separate_brepfaces(brep, crvA, Vector3d.ZAxis, out Brep brep_halfA, out Brep brep_out);
    separate_brepfaces(brep_out, crvD, -Vector3d.ZAxis, out Brep brep_halfB, out brep_out);

    double len = 0.1;
    Surface cutter = planar_srf(len, len);
    cutter.Transform(Transform.Translation(0, len * 0.5, 0));

    double[] ts = Enumerable.Range(0, sectors).Select(x => x * gap).ToArray();


    // ------- Project Curves ------- //

    crvA = crvA.Select(c => project_closest(c, brep_halfA, Vector3d.ZAxis, tol)).ToArray();
    crvB = (radii[0] == 0)
      ? crvA.Select(c => c.DuplicateCurve()).ToArray()
      : crvB.Select(c => project_closest(c, brep_halfA, Vector3d.ZAxis, tol)).ToArray();


    crvD = crvD.Select(c => project_closest(c, brep_halfB, -Vector3d.ZAxis, tol)).ToArray();
    crvC = (radii[1] == 0)
      ? crvD.Select(c => c.DuplicateCurve()).ToArray()
      : crvC.Select(c => project_closest(c, brep_halfB, -Vector3d.ZAxis, tol)).ToArray();

    sort_crvs(pln, curves, crvA);
    sort_crvs(pln, curves, crvB);
    sort_crvs(pln, curves, crvC);
    sort_crvs(pln, curves, crvD);

    Point3d central_ptA = project_point(Point3d.Origin, brep_halfA, Vector3d.ZAxis);
    Point3d central_ptB = project_point(pt_on_other_side, brep_halfB, -Vector3d.ZAxis);

    TransformGeos(crvB, Transform.Translation(0, 0, radii[0]));
    TransformGeos(crvC, Transform.Translation(0, 0, -radii[1]));



    // ------- Create test to see if surface is flat.  If so, a more simple construction can be used ------- //

    bool flat_srfA = test_flat(test_flat_crvsA, brep_halfA, Vector3d.ZAxis, tol, out _);
    bool flat_srfB = test_flat(test_flat_crvsD, brep_halfB, -Vector3d.ZAxis, tol, out _);
    //List<Curve> test_crvs = new List<Curve>();


    // ------- main loop ------- //

    for (int i = 0; i < count; i++)
    {
      crvA[i].Domain = interval;
      crvB[i].Domain = interval;
      crvC[i].Domain = interval;
      crvD[i].Domain = interval;

      bool straightA = crvA[i].IsLinear(0.01);  //crvA[i].IsLinear(0.01) && crvB[i].IsLinear(0.01);
      bool straightB = crvD[i].IsLinear(0.01);

      if (!straightA)
      {
        circle_check(ref crvA[i]);
        circle_check(ref crvD[i]);
      }

      Curve[] edges_A = new Curve[sectors];
      Curve[] edges_B = new Curve[sectors];

      for (int j = 0; j < sectors; j++)
      {
        Point3d pB = crvB[i].PointAt(ts[j]);
        Point3d pC = crvC[i].PointAt(ts[j]);
        Curve ln = new LineCurve(pC, pB);

        bool straight_checkA = (!straightA || (straightA && (j == 0 || j == sectors - 1)));
        bool straight_checkB = (!straightB || (straightB && (j == 0 || j == sectors - 1)));

        if (radii[0] != 0 && straight_checkA && bulges[0] != 0)
        {
          Point3d pA = crvA[i].PointAt(ts[j]);
          Vector3d vec = new Vector3d(pA - pB) { Z = 0 };
          vec.Unitize();
          if (flat_srfA)
          {
            Curve top_ln = new LineCurve(pA, pA + vec);
            edges_A[j] = Curve.CreateBlendCurve(ln, top_ln, BlendContinuity.Curvature, bulges[0], bulges[0]);
          }
          else
          {
            Plane frame = new Plane(pA, Vector3d.ZAxis, vec);
            Transform frame_trans = Transform.PlaneToPlane(Plane.WorldZX, frame);


            cutter.Transform(Transform.PlaneToPlane(pln, frame));
            Intersection.BrepSurface(brep_halfA, cutter, tol, out Curve[] int_crvs, out _);
            cutter.Transform(Transform.PlaneToPlane(frame, pln));
            int_crvs[0].Reverse();

            //Curve cx_crv = (int_crvs.Length > 1) ? Curve.JoinCurves(int_crvs, tol, false)[0] : int_crvs[0];
            //if (central_ptA.DistanceToSquared(cx_crv.PointAtEnd) < central_ptA.DistanceToSquared(cx_crv.PointAtStart)) cx_crv.Reverse();
            //edges_A[j] = Curve.CreateBlendCurve(ln, cx_crv, BlendContinuity.Curvature, bulges[0], bulges[0]);

            edges_A[j] = Curve.CreateBlendCurve(ln, int_crvs[0], BlendContinuity.Curvature, bulges[0], bulges[0]);
          }
        }

        if (radii[1] != 0 && straight_checkB && bulges[1] != 0)
        {
          Point3d pD = crvD[i].PointAt(ts[j]);
          Vector3d vec = new Vector3d(pD - pC) { Z = 0 };

          if (flat_srfB)
          {
            Curve top_ln = new LineCurve(pD + vec, pD);
            edges_B[j] = Curve.CreateBlendCurve(top_ln, ln, BlendContinuity.Curvature, bulges[1], bulges[1]);
          }
          else
          {
            Plane frame = new Plane(pD, -Vector3d.ZAxis, vec);
            Transform frame_trans = Transform.PlaneToPlane(Plane.WorldZX, frame);


            cutter.Transform(Transform.PlaneToPlane(pln, frame));
            Intersection.BrepSurface(brep_halfB, cutter, tol, out Curve[] int_crvs, out _);
            cutter.Transform(Transform.PlaneToPlane(frame, pln));

            //Curve cx_crv = (int_crvs.Length > 1) ? Curve.JoinCurves(int_crvs, tol, false)[0] : int_crvs[0];
            //if (central_ptB.DistanceToSquared(cx_crv.PointAtEnd) < central_ptB.DistanceToSquared(cx_crv.PointAtStart)) cx_crv.Reverse();
            //edges_A[j] = Curve.CreateBlendCurve(cx_crv, ln, BlendContinuity.Curvature, bulges[1], bulges[1]);

            edges_B[j] = Curve.CreateBlendCurve(int_crvs[0], ln, BlendContinuity.Curvature, bulges[1], bulges[1]);
          }
        }
      }


      if (radii[0] != 0)
      {
        if (straightA) final_breps[i] = (bulges[0] == 0)
            ? Brep.CreateFromLoft(new[] { crvA[i], crvB[i] }, pu, pu, LoftType.Straight, false)[0]
            : Brep.CreateFromLoft(new[] { edges_A[0], edges_A[sectors - 1] }, pu, pu, LoftType.Straight, false)[0];
        else final_breps[i] = (bulges[0] == 0)
          ? Brep.CreateFromLoft(new[] { crvB[i], crvA[i] }, pu, pu, LoftType.Straight, false)[0]
          : edge_srf(crvB[i], crvA[i], edges_A, cross_numA);
      }
      if (radii[1] != 0)
      {
        if (straightB) final_breps[(count * 2) + i] = (bulges[1] == 0)
            ? Brep.CreateFromLoft(new[] { crvC[i], crvD[i] }, pu, pu, LoftType.Straight, false)[0]
            : Brep.CreateFromLoft(new[] { edges_B[0], edges_B[sectors - 1] }, pu, pu, LoftType.Straight, false)[0];
        else final_breps[(count * 2) + i] = (bulges[1] == 0)
          ? Brep.CreateFromLoft(new[] { crvD[i], crvC[i] }, pu, pu, LoftType.Straight, false)[0]
          : edge_srf(crvD[i], crvC[i], edges_B, cross_numB);
      }
      final_breps[count + i] = Brep.CreateFromLoft(new[] { crvB[i], crvC[i] }, pu, pu, LoftType.Straight, false)[0];
    }

    //test_crvs.AddRange(crvC);
    //test_crvs.AddRange(crvD);

    //Brep test_brep = new Brep();
    //for (int i = 0; i < final_breps.Length; i++) if (final_breps[i] != null) test_brep.Append(final_breps[i]);

    //crvs = test_crvs.ToArray();
    //return test_brep;

    BoundingBox test_boxA = bb_union(crvA, 0.1);
    BoundingBox test_boxB = bb_union(crvD, 0.1);

    List<Brep> pieces = brep_halfA.Split(crvA, tol).Where(b => boxboxinside2D(test_boxA, b.GetBoundingBox(true))).ToList();
    pieces.AddRange(brep_halfB.Split(crvD, tol).Where(b => boxboxinside2D(test_boxB, b.GetBoundingBox(true))));
    pieces.AddRange(final_breps);


    Brep[] parts = Brep.JoinBreps(pieces.Where(p => p != null), 0.001, 0.1);
    Brep final_brep = new Brep();
    for (int i = 0; i < parts.Length; i++) if (parts[i] != null) final_brep.Append(parts[i]);

    if (remirror)
    {
      final_brep.Transform(mirror);
      brep.Transform(mirror);
    }

    if (final_brep.SolidOrientation == BrepSolidOrientation.Inward) final_brep.Flip();

    crvs = crvC;

    return final_brep;
  }

  private Brep full_extrude(Curve[] crvs, double extrude, List<double> radii, List<double> bulges, int sectors, bool centre, double tol, out Curve[] out_crvs)
  {
    Plane plane = curves_plane(crvs);
    Transform orient = Transform.PlaneToPlane(plane, Plane.WorldXY);
    Transform reorient = Transform.PlaneToPlane(Plane.WorldXY, plane);

    TransformGeos(crvs, orient);

    bool loop = crvs.Length == 1 && crvs[0].IsClosed;
    Point3d pu = Point3d.Unset;

    bool mirror = extrude != Math.Abs(extrude) && !centre;
    extrude = Math.Abs(extrude);

    // -------  Set Up Radii and Decide if should add Sides  ------- //

    radii = radii.Select(n => Math.Max(n, 0)).ToList();

    bool has_sides = radii[0] < extrude;
    if (!has_sides) { radii[0] = extrude; radii[1] = 0; }
    if (radii[1] > extrude - radii[0])
    {
      radii[1] = extrude - radii[0];
      has_sides = false;
    }

    bool C2arcA = bulges[0] <= -1 && (radii[0] * 1.5) <= extrude - radii[1];
    bool C2arcB = bulges[1] <= -1 && (radii[1] * 1.5) <= extrude - radii[0];
    if (C2arcA) { radii[0] *= 1.5; bulges[0] = 0.72; }
    if (C2arcB) { radii[1] *= 1.5; bulges[1] = 0.72; }

    bool has_radA = radii[0] != 0;
    bool has_radB = radii[1] != 0;


    // -------  Set Up Standard Variables  ------- //

    int count = crvs.Length;
    int v_num = (count == 1) ? v_num = sectors - 1 : sectors;

    crvs = square_crvs(crvs);
    match_crv_ends(crvs);
    Curve[] crvA = offset(crvs, -radii[0], out _, tol );
    Curve[] crvC = crvs.Select(c => c.DuplicateCurve()).ToArray();
    Curve[] crvD = offset(crvs, -radii[1], out _, tol);

    if (Math.Abs(crvA[0].PointAtStart.DistanceTo(crvs[0].PointAtStart) - radii[0]) > tol) sort_crvs(crvA, crvs);
    if (Math.Abs(crvD[0].PointAtStart.DistanceTo(crvs[0].PointAtStart) - radii[1]) > tol) sort_crvs(crvD, crvs);

    Transform moveA = Transform.Translation(0, 0, radii[0]);
    Transform moveB = Transform.Translation(0, 0, radii[1]);
    Transform moveC = Transform.Translation(0, 0, extrude - (radii[1] * 2));
    Transform moveD = Transform.Translation(0, 0, extrude);
    Transform moveC2 = Transform.Translation(0, 0, radii[1]);

    Transform mirror_trans = Transform.Mirror(Plane.WorldXY);
    Transform centre_trans = Transform.Translation(0, 0, -(extrude * 0.5));

    // -------  Main Loop - Build Surfaces  ------- //

    Brep[] srfs = new Brep[(count * 3) + 2];

    for (int i = 0; i < count; i++)
    {
      crvs[i].Transform(moveA);  // ---- Arrange Curves---- //
      crvC[i].Transform(moveB);
        int edge_num = crvs[i].IsLinear(0.01)? 2: sectors;

      if (has_radA)
      {
        int cross_num = (bulges[0] == 0) ? 2 : 4;
        Curve[] edge_curves = simple_edges(crvA[i], crvs[i], bulges[0], edge_num);
        srfs[count + i] = edge_srf(crvA[i], crvs[i], edge_curves, cross_num);
      }

      if (has_radB)
      {
        int cross_num = (bulges[1] == 0) ? 2 : 4;
        Curve[] edge_curves = simple_edges(crvD[i], crvC[i], bulges[1], edge_num);
        srfs[(count * 2) + i] = edge_srf(crvD[i], crvC[i], edge_curves, cross_num);
        srfs[(count * 2) + i].Transform(mirror_trans);
        srfs[(count * 2) + i].Transform(moveD);
      }

      crvC[i].Transform(moveC);
      if (has_sides) srfs[i] = Brep.CreateFromLoft(new[] { crvs[i], crvC[i] }, pu, pu, LoftType.Straight, false)[0];
      crvC[i].Transform(moveC2);
    }

    srfs[count * 3] = Brep.CreatePlanarBreps(crvA, 0.001)[0];
    srfs[(count * 3) + 1] = Brep.CreatePlanarBreps(crvD, 0.001)[0];
    srfs[(count * 3) + 1].Transform(moveD);

    Brep brep = Brep.JoinBreps(srfs, 0.001, 0.1)[0];


    if (mirror) { brep.Transform(mirror_trans); TransformGeos(crvC, mirror_trans); }
    if (centre) { brep.Transform(centre_trans); TransformGeos(crvC, centre_trans); }

    brep.Transform(reorient);
    TransformGeos(crvC, reorient);

    out_crvs = crvC;

    return brep;
  }

  private Brep quick_extrude(Curve[] crvs, double extrude, double radius, double bulge, int sectors, bool centre, double tol, out Curve[] out_crvs)
  {
    // -------  Set Up Conditions  ------- //

    bool loop = crvs.Length == 1 && crvs[0].IsClosed;
    bool mirror = extrude != Math.Abs(extrude) && !centre;
    extrude = Math.Abs(extrude);
    int cross_num = (bulge == 0) ? 2 : 4;

    bool has_sides = radius < extrude * 0.5;
    if (!has_sides) radius = extrude * 0.5;

    bool C2arc = bulge <= -1 && (radius * 3) + tol < extrude; // bulge is less than one and does not make the radius bigger than half the extrude
    if (C2arc)
    {
      radius *= 1.5;
      bulge = 0.72;
    }

    // -------  Set Up Standard Variables  ------- //

    int count = crvs.Length;
    Point3d pu = Point3d.Unset;

    Curve[] crvA = offset(crvs, -radius, out _, tol);
    Curve[] crvC = crvs.Select(c => c.DuplicateCurve()).ToArray();

    if (Math.Abs(crvA[0].PointAtStart.DistanceTo(crvs[0].PointAtStart) - radius) > tol)  sort_crvs(crvA, crvs);

    Transform moveB = Transform.Translation(0, 0, radius);
    Transform moveC = Transform.Translation(0, 0, extrude - radius);
    Transform moveD = Transform.Translation(0, 0, extrude);
    Transform moveC2 = Transform.Translation(0, 0, radius);
    Transform mirror_trans = Transform.Mirror(Plane.WorldXY);
    Transform centre_trans = Transform.Translation(0, 0, -(extrude * 0.5));

    // -------  Main Loop - Build Surfaces  ------- //

    Brep[] srfs = new Brep[(count * 3) + 2];

    for (int i = 0; i < count; i++)
    {
      bool straight = crvs[i].IsLinear(0.01);
      crvs[i].Transform(moveB);  // ---- Arrange Curves---- //
      crvC[i].Transform(moveC);

      if (has_sides) srfs[i] = Brep.CreateFromLoft(new[] { crvs[i], crvC[i] }, pu, pu, LoftType.Straight, false)[0];
      srfs[i].Flip();
      int edge_num = straight ? 2 : sectors;

      Curve[] edges = simple_edges(crvA[i], crvs[i], bulge, edge_num);
      srfs[count + i] = edge_srf(crvs[i], crvA[i], edges, cross_num); //

      srfs[(count * 2) + i] = srfs[count + i].DuplicateBrep();
      srfs[(count * 2) + i].Transform(mirror_trans);
      srfs[(count * 2) + i].Transform(moveD);
      crvC[i].Transform(moveC2);
    }

    srfs[count * 3] = Brep.CreatePlanarBreps(crvA, 0.001)[0];
    srfs[(count * 3) + 1] = srfs[count * 3].DuplicateBrep();
    srfs[(count * 3) + 1].Transform(moveD);

    Brep brep = Brep.JoinBreps(srfs.Where(s => s != null), 0.001, 0.1)[0];

    if (mirror) { brep.Transform(mirror_trans); TransformGeos(crvC, mirror_trans); }
    if (centre) {brep.Transform(centre_trans); TransformGeos(crvC, centre_trans); }

    out_crvs = crvC;

    return brep;
  }

  public Brep edge_srf(Curve top, Curve bottom, Curve[] edge_curves, int num, bool loop = false, double tol = 0.001)
  {
    if (num < 3 || edge_curves == null) {
      return Brep.CreateFromLoft(new[] {top, bottom}, Point3d.Unset, Point3d.Unset, LoftType.Straight, false).FirstOrDefault();
    }
    double ang_tol = 0.1;

    Vector3d start = top.TangentAtStart;
    if (start.EpsilonEquals(Vector3d.XAxis, ang_tol)) start = Vector3d.XAxis;
    else if (start.EpsilonEquals(-Vector3d.XAxis, ang_tol)) start = -Vector3d.XAxis;
    else if (start.EpsilonEquals(Vector3d.YAxis, ang_tol)) start = Vector3d.YAxis;
    else if (start.EpsilonEquals(-Vector3d.YAxis, ang_tol)) start = -Vector3d.YAxis;
    else if (start.EpsilonEquals(Vector3d.ZAxis, ang_tol)) start = Vector3d.ZAxis;
    else if (start.EpsilonEquals(-Vector3d.ZAxis, ang_tol)) start = -Vector3d.ZAxis;

    Vector3d end = top.TangentAtEnd;
    if (end.EpsilonEquals(Vector3d.XAxis, ang_tol)) end = Vector3d.XAxis;
    else if (end.EpsilonEquals(-Vector3d.XAxis, ang_tol)) end = -Vector3d.XAxis;
    else if (end.EpsilonEquals(Vector3d.YAxis, ang_tol)) end = Vector3d.YAxis;
    else if (end.EpsilonEquals(-Vector3d.YAxis, ang_tol)) end = -Vector3d.YAxis;
    else if (end.EpsilonEquals(Vector3d.ZAxis, ang_tol)) end = Vector3d.ZAxis;
    else if (end.EpsilonEquals(-Vector3d.ZAxis, ang_tol)) end = -Vector3d.ZAxis;

    int count = edge_curves.Length;
    double gap = 1 / (num - 1.0);
    Curve[] curves = new Curve[num];
    Interval interval = new Interval(0,1);
    for (int j = 0; j < count; j++) edge_curves[j].Domain = interval;

    if (edge_curves[0].PointAtStart.EpsilonEquals(top.PointAtStart, 0.01) ||
      edge_curves[0].PointAtStart.EpsilonEquals(top.PointAtEnd, 0.01))
    {
      curves[0] = top;
      curves[num - 1] = bottom;
    }
    else { curves[0] = bottom;  curves[num - 1] = top; }

    int pt_num = loop ? count + 1 : count;
    Point3d[] edge_mid_pts = new Point3d[pt_num];

    for (int i = 1; i < num - 1; i++)
    {
      double gap_size = gap * i;
      for (int j = 0; j < count; j++) edge_mid_pts[j] = edge_curves[j].PointAt(gap_size);
      if (loop) edge_mid_pts[count] = edge_mid_pts[0];

      Curve edge_mid = Curve.CreateInterpolatedCurve(edge_mid_pts, 3, CurveKnotStyle.Uniform, start, end);
      if (edge_mid.IsCircle(0.01)) edge_mid = new ArcCurve(new Circle(edge_mid_pts[0], edge_mid_pts[1], edge_mid_pts[2])); //circle_check(edge_mid, edge_mid_pts);
      else edge_mid = square_crv(edge_mid);
      curves[i] = edge_mid;
    }

    if(top.IsClosed) Array.Resize(ref edge_curves, edge_curves.Length -1);
    return NurbsSurface.CreateNetworkSurface(curves, 3, 3, edge_curves, 3, 3, tol, tol, tol, out _).ToBrep();
  }  // optimized

  public static Curve[] simple_edges(Curve crvA, Curve crvB, double bulge, int sectors)
  {
    double gap = 1 / (sectors - 1.0);
    Interval interval = new Interval(0,1);
    crvA.Domain = interval;
    crvB.Domain = interval;
    Point3d[] ptsA = new Point3d[sectors];
    Point3d[] ptsB = new Point3d[sectors];
    for (int i = 0; i < sectors; i++)
    {
      ptsA[i] = crvA.PointAt(gap * i);
      ptsB[i] = crvB.PointAt(gap * i);
    }
    // Output Chamfers
    if (bulge == 0) return ptsA.Select((p, i) => new LineCurve(p, ptsB[i])).ToArray();
    // Output Arcs
    if (bulge < 0) return ptsA.Select((p, i) => new ArcCurve(new Arc(ptsB[i], -Vector3d.ZAxis, p))).ToArray();

    // Output Blends
    Curve[] edge_curves = new Curve[sectors];
    Curve side_ln = new LineCurve(new Point3d(0, 0, 1), Point3d.Origin);
    for (int i = 0; i < sectors; i++)
    {
      Vector3d move = new Vector3d(ptsB[i]);
      Vector3d vec = new Vector3d(ptsA[i] - ptsB[i]) { Z = 0 };
      Curve crv0 = new LineCurve(ptsA[i], ptsA[i] + vec);
      side_ln.Transform(Transform.Translation(move));
      edge_curves[i] = Curve.CreateBlendCurve(side_ln, crv0, BlendContinuity.Curvature, bulge, bulge);
      side_ln.Transform(Transform.Translation(-move));
    }
    return edge_curves;
  }

  public static Brep capped_extrude(Curve[] crvs, out Curve[] out_crvs, double length = 5.0, bool centre = false, double tol = 0.01)
  {
    Point3d pu = Point3d.Unset;
    int count = crvs.Length;
    Vector3d dir = curves_plane(crvs).Normal * length;
    Transform moveC2 = Transform.Translation(dir);
    if (centre)
    {
      Transform transform = Transform.Translation(-dir * 0.5);
      for (int i = 0; i < count; i++) crvs[i].Transform(transform);
    }
    Curve[] crvC = new Curve[count];
    Brep[] sides = new Brep[count + 2];
    for (int i = 0; i < count; i++)
    {
      crvC[i] = crvs[i].DuplicateCurve();
      crvC[i].Transform(moveC2);
      sides[i + 1] = Brep.CreateFromLoft(new[] { crvs[i], crvC[i] }, pu, pu, LoftType.Straight, false)[0]; // Surface.CreateExtrusion(crvs[i], dir).ToBrep();
    }
    sides[0] = Brep.CreatePlanarBreps(crvs, 0.001)[0];
    sides[count + 1] = sides[0].DuplicateBrep();
    sides[count + 1].Transform(moveC2);

    Brep body = Brep.JoinBreps(sides, 0.001, 0.1)[0];
    if (body.SolidOrientation == BrepSolidOrientation.Inward) body.Flip();

    out_crvs = crvC;
    return body;
  }

  public static bool test_flat(Curve[] crvs, Brep brep, Vector3d direction, double tol, out Point3d[] test_pts)
  {
    int count = crvs.Length;
    Interval interval = new Interval(0,1);

    Point3d[] pts = new Point3d[count * 3];
    for (int i = 0; i < count; i++)
    {
      crvs[i].Domain = interval;
      pts[i] = project_point(crvs[i].PointAt(0.15), brep, direction);
      pts[count + i] = project_point(crvs[i].PointAt(0.5), brep, direction);
      pts[(count * 2) + i] = project_point(crvs[i].PointAt(0.85), brep, direction);
    }

    test_pts = pts;
    Plane.FitPlaneToPoints(pts, out _, out double amount);
    return amount < tol;
  }

  public static bool circle_check(ref Curve curve, double tol = 0.01)  // ******** Needs Love
  {
    bool iscircle = curve.TryGetCircle(out Circle circle, tol);
    Point3d test_pt = curve.PointAtStart;
    if (iscircle) curve = new ArcCurve(circle);
    curve.ClosestPoint(test_pt, out double t);
    curve.ChangeClosedCurveSeam(t);
    //bool iscircle = curve.IsCircle(tol);
    //if (iscircle) curve = new ArcCurve(new Arc(curve.PointAtStart, curve.TangentAtStart, curve.PointAtEnd));
    return iscircle;
  }

  public static Curve[] object_curve_convert(List<object> objects)
  {
    int count = objects.Count;
    Curve[] curves = new Curve[count];
    for (int i = 0; i < count; i++)
    {
      if (objects[i] is Curve) curves[i] = objects[i] as Curve;
      else if (objects[i] is Line) curves[i] = new LineCurve((Line)objects[i]);
      else if (objects[i] is Circle) curves[i] = new ArcCurve((Circle)objects[i]);
      else curves[i] = new ArcCurve((Arc)objects[i]);
    }
    return curves;
  }

  public static void separate_brepfaces(Brep brep, Curve[] crvs, Vector3d direction, out Brep brep_in, out Brep brep_out)
  {
    double tol = 0.001;
    int count = crvs.Length;
    Interval interval = new Interval(0,1);
    Point3d[] pts = new Point3d[count * 3];
    for (int i = 0; i < count; i++)
    {
      crvs[i].Domain = interval;
      pts[i] = project_point(crvs[i].PointAt(0.15), brep, direction);
      pts[count + i] = project_point(crvs[i].PointAt(0.5), brep, direction);
      pts[(count * 2) + i] = project_point(crvs[i].PointAt(0.85), brep, direction);
    }

    HashSet<int> index_in = new HashSet<int>();
    for (int i = 0; i < count * 3; i++)
    {
      brep.ClosestPoint(pts[i], out _, out ComponentIndex ci, out _, out _, tol, out _);
      index_in.Add(ci.Index);
    }
    int[] index_out = new int[brep.Faces.Count - index_in.Count];
    int counter = 0;
    for (int i = 0; i < brep.Faces.Count; i++)
    {
      if (!index_in.Contains(i))
      {
        index_out[counter] = i;
        counter++;
      }
    }

    brep_in = brep.DuplicateSubBrep(index_in);
    brep_out = brep.DuplicateSubBrep(index_out);
  }

  public static void clean_lines(ref Curve[] curves, double tol = 0.01)
  {
    int count = curves.Length;

    // Use a HashSet to track indices to remove for faster lookups
    HashSet<int> removeSet = new HashSet<int>();

    for (int i = 0; i < count; i++)
    {
      int next = (i + 1) % count;
      if (curves[i].IsLinear(0.01) && curves[next].IsLinear(0.01))
      {
        if (curves[i].TangentAtEnd.EpsilonEquals(curves[next].TangentAtStart, 0.01))
        {
          curves[i] =  new LineCurve(curves[i].PointAtStart, curves[next].PointAtEnd);
          removeSet.Add(next);
        }
      }
    }

    // Filter out curves that need to be removed using LINQ
    curves = curves
        .Where((curve, index) => !removeSet.Contains(index))
        .ToArray();
  }

  private void match_crv_ends(Curve[] curves)
  {
    int count = curves.Length;
    List<Point3d> straight_pts = new List<Point3d> ();
    List<Curve> curved = new List<Curve>();
    for (int i = 0; i < count; i++)
    {
      if (curves[i].IsLinear(0.01))
        {
        straight_pts.Add(curves[i].PointAtStart);
        straight_pts.Add(curves[i].PointAtEnd);
      }
      else
      {
        curved.Add(curves[i]);
      }
    }

    for (int i = 0; i < curved.Count; i++)
    {
      Point3d start_pt = curved[i].PointAtStart;
      Point3d end_pt = curved[i].PointAtEnd;
      for (int j = 0; j < straight_pts.Count; j++) {
        Point3d test_pt = straight_pts[j];
        if (start_pt.EpsilonEquals(test_pt, 0.01)) curved[i].SetStartPoint(test_pt);
        if (end_pt.EpsilonEquals(test_pt, 0.01)) curved[i].SetEndPoint(test_pt);
      }
    }
  }

  public static NurbsSurface planar_srf(double x = 1, double y = 1)
  {
    x *= 0.5;
    y *= 0.5;

    return NurbsSurface.CreateFromCorners(
      new Point3d(-x, -y, 0),
      new Point3d(-x, y, 0),
      new Point3d(x, y, 0),
      new Point3d(x, -y, 0));
  }

  public static BoundingBox bb_union<T>(IList<T> geos, double inflate = 0) where T : GeometryBase
  {
    BoundingBox bb = BoundingBox.Empty;
    for (int i = 0; i < geos.Count; i++) bb.Union(geos[i].GetBoundingBox(true));
    if (inflate != 0) bb.Inflate(inflate);
    return bb;
  }

  public static void sort_crvs(Curve[] curvesA, Curve[] curvesB, double tol = 0.001)
  {
    sort_crv(curvesA, tol);

    // Initialize first curve for crvsB
    //InitializeFirstCurveB(curvesA[0], curvesB.ToList(), curvesB, tol);
    set_first_curve(curvesA[0], ref curvesB);

    sort_crv(curvesB, tol);
  }

  public static void sort_crvs(Plane plane, Curve[] curvesA, Curve[] curvesB, double tol = 0.001)
  {
    int count = curvesA.Length;
    Transform flatten = Transform.Scale(plane, 1, 1, 0);
    Curve[] cA = curvesA.Select(c => c.DuplicateCurve()).ToArray();
    Curve[] cB = curvesB.Select(c => c.DuplicateCurve()).ToArray();

    TransformGeos(cA, flatten);
    TransformGeos(cB, flatten);

    int[] sortA = sort_index(cA, out bool[] flipA);

    bool flip = set_first_curve(cA[0], ref cB);

    int[] sortB = sort_index(cB, out bool[] flipB);
    flipB[0] = flip;

    Array.Sort(sortA, curvesA);
    Array.Sort(sortB, curvesB);
    Array.Sort(sortA, flipA);
    Array.Sort(sortB, flipB);

    for (int i = 0;  i < count; i++) {
      if (flipA[i]) curvesA[i].Reverse();
      if (flipB[i]) curvesB[i].Reverse();
    }
  }

  public static bool set_first_curve(Curve crv, ref Curve[] curve_list, double tol = 0.001)
  {
    bool flip = false;

    int count = curve_list.Length;
    Interval interval = new Interval(0,1);
    double inset = 0.3;

    crv.Domain = interval;
    Point3d ptA = crv.PointAt(inset);
    Point3d ptB = crv.PointAt(1 - inset);

    double minDistance = double.MaxValue;
    int start = 0;

    for (int i = 0; i < count; i++)
    {
      curve_list[i].Domain = interval;
      Point3d pt0 = curve_list[i].PointAt(inset);
      Point3d pt1 = curve_list[i].PointAt(1 - inset);

      double distance = Math.Min(ptA.DistanceToSquared(pt0), ptA.DistanceToSquared(pt1)) + Math.Min(ptB.DistanceToSquared(pt0), ptB.DistanceToSquared(pt1));

      if (distance < minDistance) {
        minDistance = distance;
        start = i;
      }
    }

    if (start > 0)
    {
      Curve[] sorted = new Curve[count];
      Array.Copy(curve_list, start, sorted, 0, count - start);
      Array.Copy(curve_list, 0, sorted, count - start, start);
      curve_list = sorted;
    }

    if (ptA.DistanceToSquared(curve_list[0].PointAt(inset)) > ptA.DistanceToSquared(curve_list[0].PointAt(1 - inset)))
    {
      curve_list[0].Reverse();
      flip = true;
    }
    return flip;
  }

  public static void sort_crv(Curve[] curves, double tol = 0.01)
  {
    int count = curves.Length;
    List<Curve> crvs = curves.Skip(1).ToList();

    for (int i = 0; i < count - 1; i++)
    {
      Point3d end = curves[i].PointAtEnd;
      for (int j = 0; j < crvs.Count; j++)
      {
        if (end.EpsilonEquals(crvs[j].PointAtStart, tol))
        {
          curves[i + 1] = crvs[j];
          crvs.RemoveAt(j);
          break;
        }
        else if (end.EpsilonEquals(crvs[j].PointAtEnd, tol))
        {
          crvs[j].Reverse();
          curves[i + 1] = crvs[j];
          crvs.RemoveAt(j);
          break;
        }
      }
    }
  }

  public static int[] sort_index(Curve[] curves, out bool[] flip, double tol = 0.01)
  {
    int count = curves.Length;

    int[] idx = new int[count];
    bool[] flip_bool = new bool[count]; // defaults to 'false' so no need to add assign anything other than 'true'

    List<Curve> crvs = new ArraySegment<Curve>(curves, 1, count - 1).ToList();
    List<int> idx_list = Enumerable.Range(1, count-1).ToList();

    for (int i = 0; i < count - 1; i++)
    {
      Point3d end = curves[i].PointAtEnd;
      for (int j = 0; j < crvs.Count; j++)
      {
        if (end.EpsilonEquals(crvs[j].PointAtStart, tol))
        {
          curves[i + 1] = crvs[j];
          crvs.RemoveAt(j);
          idx[i + 1] = idx_list[j];
          idx_list.RemoveAt(j);
          break;
        }
        else if (end.EpsilonEquals(crvs[j].PointAtEnd, tol))
        {
          flip_bool[i + 1] = true;
          crvs[j].Reverse();
          curves[i + 1] = crvs[j];
          crvs.RemoveAt(j);
          idx[i + 1] = idx_list[j];
          idx_list.RemoveAt(j);
          break;
        }
      }
    }
    flip = flip_bool;
    return idx;
  }

  public static Point3d project_point(Point3d pt, Brep brep, Vector3d direction) // Optimised
  {
    pt = new Point3d(pt - direction);
    Point3d[] pts = Intersection.RayShoot(new Ray3d(pt, direction), new[] { brep }, 2);
    if (pts.Length == 1) return pts[0];
    if (pts.Length == 2)
    {
      double dist1 = pt.DistanceToSquared(pts[0]);
      double dist2 = pt.DistanceToSquared(pts[1]);
      return dist1 < dist2 ? pts[0] : pts[1];
    }
    if (pts.Length > 2)
    {
      double[] distances = pts.Select(p => pt.DistanceToSquared(p)).ToArray();
      return pts[Array.IndexOf(distances, distances.Min())];
    }
    return pt;
  }

  public static Curve project_closest(Curve crv, Brep brep, Vector3d dir, double tol)  // Optimised
  {
    Interval interval = new Interval(0, 1);

    crv.Transform(Transform.Translation(-dir));
    Curve[] projected_curves = Curve.ProjectToBrep(crv, brep, dir, tol);
    Curve[] projected_joined = Curve.JoinCurves(projected_curves, tol, false);

    Point3d centre = crv.GetBoundingBox(true).Center;
    int closestIndex = 0;
    double minDistance = double.MaxValue;

    for (int i = 0; i < projected_joined.Length; i++)
    {
      projected_joined[i].Domain = interval;
      double distance = centre.DistanceToSquared(projected_joined[i].GetBoundingBox(true).Center);
      if (distance < minDistance) {
        minDistance = distance;
        closestIndex = i;
      }

    }
    return projected_joined[closestIndex];
  }

  public static Plane curves_plane(Curve[] curves, double tol = 0.01)  // Optimized
  {
    int count = curves.Length;
    BoundingBox bb = bb_union(curves);

    if (bb.Max.Z - bb.Min.Z < 0.01) return new Plane(bb.Center, Vector3d.XAxis, Vector3d.YAxis); // XY Plane
    if (bb.Max.X - bb.Min.X < 0.01) return new Plane(bb.Center, Vector3d.YAxis, Vector3d.ZAxis); // ZY Plane
    if (bb.Max.Y - bb.Min.Y < 0.01) return new Plane(bb.Center, Vector3d.XAxis, Vector3d.ZAxis); // ZX Plane

    HashSet<Plane> uniquePlanes = new HashSet<Plane>();
    for (int i = 0; i < count; i++)
    {
      if (curves[i].TryGetPlane(out Plane pl, tol))
      {
        pl.Origin = bb.Center;
        uniquePlanes.Add(pl);
      }
    }
    return uniquePlanes.First();
  }

  public Curve[] offset(Curve[] curves, double fillet, out Plane pln, double tol = 0.001)
  {
    int count = curves.Length;
    Plane plane = curves_plane(curves);
    pln = plane;
    if (fillet == 0)
    {
      Curve[] dups = new Curve[count];
      for (int i = 0; i < count; i++) dups[i] = curves[i].DuplicateCurve();
      return dups;
    }

    Curve[] off1 = new Curve[count];
    Curve[] off2 = new Curve[count];
    Point3d pt = plane.Origin;
    Vector3d normal = plane.Normal;
    CurveOffsetCornerStyle cs = CurveOffsetCornerStyle.Smooth;
    CurveOffsetEndStyle es = CurveOffsetEndStyle.None;

    for(int i = 0; i < count; i++){
      bool offset_type = !curves[i].IsArc(0.1);
      off1[i] = Curve.JoinCurves(curves[i].Offset(pt, normal, fillet, tol, tol, offset_type, cs, es), tol, false)[0];
      off2[i] = Curve.JoinCurves(curves[i].Offset(pt, normal, -fillet, tol, tol, offset_type, cs, es), tol, false)[0];
    }

    double len1 = bb_union(off1).Diagonal.Length;
    double len2 = bb_union(off2).Diagonal.Length;

    if ((fillet > 0) == (len1 < len2)) return neaten_crvs(loop_crv(off2, fillet), curves);
    return square_crvs(loop_crv(off1, fillet));

    //return neaten_crvs(loop_crv(off2, fillet), curves);
    //return neaten_crvs(loop_crv(off1, fillet), curves);
  }


  public Curve[] neaten_crvs(Curve[] crvs, Curve[] match_crvs, double tol = 0.1)
  {
    /// Designed for offset curves, where initial curves (match_crvs) are in a sorted loop, and the crvs also is a corresponding sorted loop
    /// Will also work for a single loop of curves that is not necessarily offset.  Just set match_crvs to 'null'.

    int count = crvs.Length;
    Interval interval = new Interval(0,1);

    bool[] end_curvature_matches = new bool[count];
    bool[] is_linear = new bool[count];
    Vector3d[] end_tan = new Vector3d[count];
    Vector3d[] vecs = { Vector3d.XAxis, -Vector3d.XAxis, Vector3d.YAxis, -Vector3d.YAxis, Vector3d.ZAxis, -Vector3d.ZAxis };

    if (match_crvs.Length == count){
      for (int i = 0; i < count; i++)
      {
        crvs[i].Domain = interval;
        match_crvs[i].Domain = interval;
        is_linear[i] = match_crvs[i].IsLinear(tol);
        end_tan[i] = match_crvs[i].TangentAtEnd;
        for (int j = 0; j < 6; j++) if (end_tan[i].EpsilonEquals(vecs[j], tol)) end_tan[i] = vecs[j];
      }

      for (int i = 0; i < count; i++){
        int last = (i-1 + count) % count;
        end_curvature_matches[i] = match_crvs[i].CurvatureAt(0).EpsilonEquals(match_crvs[last].CurvatureAt(1), 0.1) && match_crvs[i].TangentAtStart.EpsilonEquals(end_tan[last], 0.1);
      }
    }else{
      for (int i = 0; i < count; i++)
      {
        crvs[i].Domain = interval;
        is_linear[i] = crvs[i].IsLinear(tol);
        end_tan[i] = crvs[i].TangentAtEnd;
        for (int j = 0; j < 6; j++) if (end_tan[i].EpsilonEquals(vecs[j], tol)) end_tan[i] = vecs[j];
      }

      for (int i = 0; i < count; i++){
        int last = (i-1 + count) % count;
        end_curvature_matches[i] = crvs[i].CurvatureAt(0).EpsilonEquals(crvs[last].CurvatureAt(1), 0.1) && crvs[i].TangentAtStart.EpsilonEquals(end_tan[last], 0.1);
      }
    }


  // string test_vecs = "";
  // for (int i = 0; i < count; i++) test_vecs += is_linear[i].ToString() + ", " + crvs[i].ToNurbsCurve().Points.Count.ToString() +"|  " ;
  // Print(test_vecs);

  for (int i = 0; i < count; i++){
    if(is_linear[i] || !end_curvature_matches[i] || crvs[i].IsArc(0.1)) continue;


    NurbsCurve curve = crvs[i].ToNurbsCurve();
    int ptnum = curve.Points.Count;
    Print(ptnum.ToString());

    Point3d[] pts = curve.Points.Select(p => p.Location).ToArray();
    int degree = curve.Degree;
    if(ptnum < 6) continue;

    // ------- Square ends if not square

    Vector3d tan = end_tan[(i-1+ count)%count];
    tan.Unitize();
    pts[1] = new Point3d(pts[0] + (tan * pts[0].DistanceTo(pts[1])));
    pts[2] = new Point3d(pts[0] + (tan * pts[0].DistanceTo(pts[2])));

    if (is_linear[(i+1) % count]){
      tan = -end_tan[i];
      tan.Unitize();
      pts[ptnum -2] = new Point3d(pts[ptnum -1] + (tan * pts[ptnum -1].DistanceTo(pts[ptnum -2])));
      pts[ptnum -3] = new Point3d(pts[ptnum -1] + (tan * pts[ptnum -1].DistanceTo(pts[ptnum -3])));
    }

    crvs[i] = NurbsCurve.Create(false, degree, pts);
  }
  return crvs;
}

  public Curve[] square_crvs(Curve[] crvs, double tol = 0.1){
      int count = crvs.Length;
      for (int i = 0; i < count; i++) crvs[i] = square_crv(crvs[i]);
      return crvs;
  }

  public Curve square_crv(Curve crv, double tol = 0.1)
  {
    if(crv.IsLinear(0.01) || crv.IsArc(0.1)) return crv;

    NurbsCurve curve = crv.ToNurbsCurve();
    Point3d[] pts = curve.Points.Select(p => p.Location).ToArray();
    int count = pts.Length;
    if(curve.Points.Count < 6) return crv;

    Vector3d[] vecs = { Vector3d.XAxis, -Vector3d.XAxis, Vector3d.YAxis, -Vector3d.YAxis, Vector3d.ZAxis, -Vector3d.ZAxis };
    Vector3d start_vec = curve.TangentAtStart;
    Vector3d end_vec = curve.TangentAtEnd;

    bool start_found = false;
    bool end_found = false;

    for (int j = 0; j < 6; j++)
      {
        if (!start_found && start_vec.EpsilonEquals(vecs[j], tol))
        {
          if (vecs[j].X == 0) pts[1].X = pts[2].X = pts[0].X;
          if (vecs[j].Y == 0) pts[1].Y = pts[2].Y = pts[0].Y;
          if (vecs[j].Z == 0) pts[1].Z = pts[2].Z = pts[0].Z;
          start_found = true;
        }

        if (!end_found && end_vec.EpsilonEquals(vecs[j], tol))
        {
          if (vecs[j].X == 0) pts[count-2].X = pts[count-3].X = pts[count-1].X;
          if (vecs[j].Y == 0) pts[count-2].Y = pts[count-3].Y = pts[count-1].Y;
          if (vecs[j].Z == 0) pts[count-2].Z = pts[count-3].Z = pts[count-1].Z;
          end_found = true;
        }
        if (start_found && end_found) break;
      }
    return Curve.CreateControlPointCurve(pts, curve.Degree);
  }

  public static Curve[] loop_crv(Curve[] curves, double radius, double tol = 0.001)
  {
    if(Curve.JoinCurves(curves, tol, false)[0].IsClosed) return curves;

    int count = curves.Length;
    radius = Math.Abs(radius) * 2;

    //bool[] is_arc = new bool[count];
    Point3d[] startPoints = new Point3d[count];
    Point3d[] endPoints = new Point3d[count];
    double[] extendMin = new double[count];
    double[] extendMax = new double[count];

    for (int i = 0; i < count; i++)
    {
      //is_arc[i] = curves[i].IsArc(0.1);
      startPoints[i] = curves[i].PointAtStart;
      endPoints[i] = curves[i].PointAtEnd;
      extendMin[i] = curves[i].Domain.Min - radius;
      extendMax[i] = curves[i].Domain.Max + radius;
    }

    for (int i = 0; i < count; i++)
    {
      //if(is_arc[i]) continue;
      int last = (i + count - 1) % count;
      int next = (i + 1) % count;

      if (!startPoints[i].EpsilonEquals(endPoints[last], tol))
        curves[i] = curves[i].Extend(extendMin[i], curves[i].Domain.Max);
      if (!endPoints[i].EpsilonEquals(startPoints[next], tol))
        curves[i] = curves[i].Extend(curves[i].Domain.Min, extendMax[i]);
    }

    for (int i = 0; i < count; i++)
    {
      //if(is_arc[i]) continue;
      int last = (i + count - 1) % count;
      int next = (i + 1) % count;

      if (!startPoints[i].EpsilonEquals(endPoints[last], tol))
      {
        CurveIntersections cx = Intersection.CurveCurve(curves[i], curves[last], tol, tol);
        curves[i] = curves[i].Split(cx[0].ParameterA)[1];
        curves[last] = curves[last].Split(cx[0].ParameterB)[0];
      }
    }

    Interval interval = new Interval(0, 1);
    for (int i = 0; i < count; i++)
    {
      //if(is_arc[i]) continue;
      int degree = curves[i].Degree;
      Vector3d start = curves[i].TangentAtStart;
      Vector3d end = curves[i].TangentAtEnd;
      curves[i].Domain = interval;
      if (curves[i].CurvatureAt(0.5).SquareLength > 200 || curves[i].DuplicateSegments().Length > 1)
      {
        BoundingBox bb = curves[i].GetBoundingBox(true);

        int ptnum = (int)Math.Max(9, Math.Floor(curves[i].ToNurbsCurve().Points.Count * 1.0));
        Curve crv = curves[i].Rebuild(ptnum, degree, true);
        Point3d[] pts = crv.ToNurbsCurve().Points.Select(p => p.Location).ToArray();
        for (int j = 0; j < pts.Length; j++)
        {
            pts[j].X = Math.Max(bb.Min.X, Math.Min(bb.Max.X, pts[j].X));
            pts[j].Y = Math.Max(bb.Min.Y, Math.Min(bb.Max.Y, pts[j].Y));
            pts[j].Z = Math.Max(bb.Min.Z, Math.Min(bb.Max.Z, pts[j].Z));
        }
        curves[i] = Curve.CreateControlPointCurve(pts, degree); //NurbsCurve.Create(false, degree, pts);
      }
    }
    return curves;
  }

  public static bool boxboxinside2D(BoundingBox a, BoundingBox b)
  {
    if (a.Max.X < b.Max.X) return false;
    if (a.Min.X > b.Min.X) return false;
    if (a.Max.Y < b.Max.Y) return false;
    if (a.Min.Y > b.Min.Y) return false;

    return true;
  }

  public static void TransformGeos<T>(IList<T> geos, Transform transform) where T : GeometryBase
  {
    for (int i = 0; i < geos.Count; i++) geos[i].Transform(transform);
  }

  public bool no_input(string name) => Component.Params.Input[Component.Params.IndexOfInputParam(name)].SourceCount == 0;
# ---------- end extrude_punch ----------
para_2 = ScriptParasite(Enable=Toggle(True), Folder=scripts_2)

nake = CSharpScript(brep=extrude_punch.surfaces)  # -> crvs, num; inputs brep: Brep
# ---------- nake: C# ----------
    Component.Message = "Naked Edges";

    List<int> indices = new List<int>();
    List<Curve> curves = new List<Curve>();

    for (int i = 0; i < brep.Edges.Count; i++)
    {
      if (brep.Edges[i].AdjacentFaces().Length == 1)
      {
        indices.Add(i);
        curves.Add(brep.Edges[i].DuplicateCurve());
      }
    }

    crvs = curves;
    num = indices;
# ---------- end nake ----------
m = MidPoint(crv=nake.crvs)  # -> mid; inputs crv: Curve
# ---------- m: C# ----------
    
    crv.Domain = new Interval(0, 1);
    mid = crv.PointAt(0.5);
# ---------- end m ----------
zebra = ZebraStripes(brep=extrude_punch.surfaces)  # inputs brep: Brep, scale: Double, rotate: Double
# ---------- zebra: C# usings ----------
using System.Drawing;
using Rhino.Display;
using Rhino.DocObjects;
using System.Linq;
using System.IO;
# ---------- zebra: C# ----------
    if (no_input("scale")) scale = 1.0;
    if (no_input("rotate")) rotate = 0.0;

    //string filepath = @"D:\\Core_Files\\zebra.bmp";

    string userObjectsPath = Path.Combine(
    System.Environment.GetFolderPath(System.Environment.SpecialFolder.ApplicationData), "Grasshopper", "UserObjects");

    Directory.CreateDirectory(userObjectsPath);
    string filepath = Path.Combine(userObjectsPath, "zebra.bmp");


    if (no_input("brep") || brep == null) return;
    if (!System.IO.File.Exists(filepath)) {
      byte[] bmp = new byte[]
      {
            0x42, 0x4D, 0x56, 0x00, 0x00, 0x00, 0x00, 0x00, 0x00, 0x00, 0x36, 0x00,
            0x00, 0x00, 0x28, 0x00, 0x00, 0x00, 0x0A, 0x00, 0x00, 0x00, 0x01, 0x00,
            0x00, 0x00, 0x01, 0x00, 0x18, 0x00, 0x00, 0x00, 0x00, 0x00, 0x20, 0x00,
            0x00, 0x00, 0x13, 0x0B, 0x00, 0x00, 0x13, 0x0B, 0x00, 0x00, 0x00, 0x00,
            0x00, 0x00, 0x00, 0x00, 0x00, 0x00, 0x00, 0x00, 0x00, 0x00, 0x00, 0x00,
            0x00, 0x00, 0x00, 0x00, 0x00, 0x00, 0x00, 0x00, 0x00, 0xFF, 0xFF, 0xFF,
            0xFF, 0xFF, 0xFF, 0xFF, 0xFF, 0xFF, 0xFF, 0xFF, 0xFF, 0xFF, 0xFF, 0xFF,
            0x00, 0x00
      };
      File.WriteAllBytes(filepath, bmp);
    }

    // Create a texture from the temporary file
    Texture texture = new Texture() { FileName = filepath };

    // Normalize scale within the specified range and invert
    scale = 25 / Math.Max(0.02, Math.Min(scale, 2.0));

    // Apply transformations to the texture
    texture.UvwTransform =  Transform.Rotation(rotate, Point3d.Origin) * Transform.Scale(Point3d.Origin, scale);

    DisplayMaterial mat = new DisplayMaterial(Color.White);
    mat.SetEnvironmentTexture(texture, true);  // add texture on front
    mat.SetEnvironmentTexture(texture, false); // add texture on back

    Mesh[] meshes = Mesh.CreateFromBrep(brep, MeshingParameters.QualityRenderMesh);
    Mesh M = new Mesh();
    foreach (Mesh partialMesh in meshes) M.Append(partialMesh);

    m_shapes.Add(M);
    m_materials.Add(mat);
# ---------- zebra: C# additional code ----------
  private bool no_input(string name)
  {
    string[] names = Component.Params.Input.Select(x => x.NickName.Trim()).ToArray();
    int input_idx = Array.IndexOf(names, name);
    return Component.Params.Input[input_idx].SourceCount == 0;
  }

  private BoundingBox m_box;
  private List<Mesh> m_shapes;
  private List<DisplayMaterial> m_materials;

  public override void BeforeRunScript()
  {
      BoundingBox m_box = BoundingBox.Empty;
      m_shapes = new List<Mesh>();
      m_materials = new List<DisplayMaterial>();
  }

  public override BoundingBox ClippingBox
  {
      get { return m_box; }
  }

  public override void DrawViewportMeshes(IGH_PreviewArgs args)
  {
      if (m_shapes == null) return;
      for (int i = 0; i < m_shapes.Count; i++)
      {
          args.Display.DrawMeshShaded(m_shapes[i], m_materials[i]);
      }
  }
# ---------- end zebra ----------
pill = CSharpScript()  # -> curves, joined; inputs rect: Double, radii: Double
# ---------- pill: C# usings ----------
using System.Linq;
# ---------- pill: C# ----------
    // Update 2025-05-24
    if (no_input("radii")) radii = 1.25;
    if (no_input("rect")) rect = 6;

    Curve[] pill_crvs = pill(rect, radii);

    curves = pill_crvs.Select(c => new GH_Curve(c));
    joined =  new GH_Curve(Curve.JoinCurves(pill_crvs, 0.01, false)[0]);
# ---------- pill: C# additional code ----------
  Curve[] pill(double rect, double radius)
  {
    Point3d[] pts = {
      new Point3d(-rect * 0.5, -radius, 0),
      new Point3d(-rect * 0.5, radius, 0),
      new Point3d(rect * 0.5, radius, 0),
      new Point3d(rect * 0.5, -radius, 0),
      };

    Curve [] crvs = {
      new ArcCurve(new Arc(pts[0], -Vector3d.XAxis, pts[1])),
      new LineCurve(pts[1], pts[2]),
      new ArcCurve(new Arc(pts[2], Vector3d.XAxis, pts[3])),
      new LineCurve(pts[3], pts[0])
    };

    return crvs;
  }


  Curve[] pill(double rect, double radius, out Point3d[] pts)
  {
    pts = new[] {
      new Point3d(-rect * 0.5, -radius, 0),
      new Point3d(-rect * 0.5, radius, 0),
      new Point3d(rect * 0.5, radius, 0), 
      new Point3d(rect * 0.5, -radius, 0)
      };

    Curve [] crvs = {
      new ArcCurve(new Arc(pts[0], -Vector3d.XAxis, pts[1])),
      new LineCurve(pts[1], pts[2]),
      new ArcCurve(new Arc(pts[2], Vector3d.XAxis, pts[3])),
      new LineCurve(pts[3], pts[0])
    };

    return crvs;
  }


  private bool no_input(string name) => Component.Params.Input[Component.Params.IndexOfInputParam(name)].SourceCount == 0;
# ---------- end pill ----------
panel_2 = Panel([extrude_punch.surfaces, nake.crvs])
